vi "Main Loop.gvi"   [LabVIEW NXG 5.1.0]
inputs:
  "graph": "Graph reference"
types:
  "Vertex.gtype" = cluster{"x": u8, "y": u8}
  "Frame Info (XY Graph).gtype" = cluster{"Clear Screen": bool, "Palette Data": bool, "Indexed": bool, "Indexed Verts": "Vertex.gtype"[], "Frame": i32, "Plots": cluster{"x": f64[], "y": f64[]}[]}
  "Color.gtype" = u32
uses:
  NICCC::Read Bytes from Scene.gvi
  NICCC::Read Byte.gvi
  NICCC::Read Word.gvi
diagram:
  Initialize Array(element=cluster{"x": f64[], "y": f64[]} {all zero or empty}, size=16) -> w1
  w2 = "Init"  # State
  # See http://arsantica-online.com/st-niccc-competition/ for binary file + format details.
  s1 = w2  # shift register
  s2 = "Frame Info (XY Graph).gtype" {all zero or empty}  # shift register
  while {
    case (s1) {
      frame "Init" {
        call "Read Bytes from Scene.gvi"(bytes to read=0) -> (error out=w5)
        Property Node(instance in="Frame Info (XY Graph).gtype" {all zero or empty}, "Plots"=w1) -> (instance out=w3)
        w7 = "Read Flags"  # State
        w4 = w7
        w6 = default
      }
      frame "Read Flags" {
        call "Read Byte.gvi"() -> (Word=w8, error out=w5)
        Number To Boolean Array(number=w8) -> (Boolean array=w9)
        Array Index(array=w9) -> (out0[_]=w10, out1[_]=w11, out2[_]=w12)
        Property Node(instance in=s2) -> ("Frame"=w13)
        Increment(x=w13) -> w14
        Property Node(instance in=s2, "Frame"=w14, "Clear Screen"=w10, "Palette Data"=w11, "Indexed"=w12) -> (instance out=w3)
        w15 = "Clear Screen"  # State
        w4 = w15
        w6 = default
      }
      frame "Clear Screen" {
        # While the scene file contains a flag to clear the screen every so often, there are instances where hundreds of vertexes and filled shapes accumulate in the canvas. LabVIEW's 2D picture chokes as it is drawing each and every shape regardless of visibility. Instead just clear every frame.
        case (TRUE) {
          frame False, Default {
            w3 = s2
          }
          frame True {
            Property Node(instance in=s2, "Plots"=w1) -> (instance out=w3)
          }
        }
        w16 = "Update Palette"  # State
        Property Node(instance in=s2) -> ("Plots"=w17)
        for {
          w18 = each element of w17
          Property Node(instance in=w18) -> ("y"=w20, instance out=w21)
          Subtract(x=200, y=w20) -> w22
          Property Node(instance in=w21, "y"=w22) -> (instance out=w23)
          append w23 to w19
        }
        Property Node(instance in=$graph, "Value"=w19)
        w4 = w16
        w5 = default
        w6 = default
      }
      frame "Update Palette" {
        Property Node(instance in=s2) -> ("Palette Data"=w24, "Indexed"=w25)
        case (w24) {
          frame False, Default {
            w3 = s2
            w5 = default
          }
          frame True {
            call "Read Word.gvi"() -> (Word=w26, error out=w27)
            Number To Boolean Array(number=w26) -> (Boolean array=w28)
            Reverse 1D Array(array=w28) -> (reversed array=w29)
            s3 = w27  # shift register
            for (iteration -> i1) {
              w30 = each element of w29
              case (w30) {
                frame False, Default {
                  w31 = s3
                }
                frame True {
                  Property Node(instance in=$graph, "ActivePlot"=i1) -> ("Plot"=w32)  # Graph properties
                  To Unsigned 32 Bit Integer(number=0xFF) -> w33
                  Scale By Power Of 2(n=24, x=w33) -> w34
                  call "Read Word.gvi"(error in=s3) -> (Word=w35, error out=w31)
                  Scale By Power Of 2(n=-8, x=w35) -> w36
                  Logical And(0x7, w36) -> w37
                  Multiply(36, w37) -> w38
                  To Unsigned 32 Bit Integer(number=w38) -> w39
                  Scale By Power Of 2(n=16, x=w39) -> w40
                  Scale By Power Of 2(n=-4, x=w35) -> w41
                  Logical And(0x7, w41) -> w42
                  Multiply(36, w42) -> w43
                  To Unsigned 32 Bit Integer(number=w43) -> w44
                  Scale By Power Of 2(n=8, x=w44) -> w45
                  Logical And(0x7, w35) -> w46
                  Multiply(36, w46) -> w47
                  To Unsigned 32 Bit Integer(number=w47) -> w48
                  # Multiply by 36 to scale 3 bit color to 8 bit color
                  Scale By Power Of 2(n=0, x=w48) -> w49
                  Logical Or(w34, w40, w45, w49) -> w50
                  To Variant(anything=w50) -> w51
                  Variant To Data(type="Color.gtype" 4278190080, variant=w51) -> (data=w52)
                  Property Node(instance in=w32, "Color"=w52)
                }
              }
              next s3 = w31
            }
            w3 = s2
            w5 = s3
          }
        }
        w53 = "Draw Polygons"  # State
        w54 = "Read Indexed"  # State
        Select(s=w25, t=w54, f=w53) -> w4
        w6 = default
      }
      frame "Read Indexed" {
        call "Read Byte.gvi"() -> (Word=w55, error out=w56)
        s4 = w56  # shift register
        for (N = w55) {
          call "Read Byte.gvi"(error in=s4) -> (Word=w58, error out=w59)
          call "Read Byte.gvi"(error in=w59) -> (Word=w60, error out=w61)
          Property Node(instance in="Vertex.gtype" {all zero or empty}, "y"=w60, "x"=w58) -> (instance out=w62)
          append w62 to w57
          next s4 = w61
        }
        Property Node(instance in=s2, "Indexed Verts"=w57) -> (instance out=w3)
        w63 = "Draw Polygons"  # State
        w4 = w63
        w5 = s4
        w6 = default
      }
      frame "Draw Polygons" {
        call "Read Byte.gvi"() -> (Word=w64, error out=w65)
        case (w64) {
          frame Default {
            Property Node(instance in=s2) -> ("Indexed"=w66)
            Logical And(w64, 0xF) -> w67
            case (w66) {
              frame True {
                s5 = s2  # shift register
                s6 = w65  # shift register
                for (N = w67) {
                  Property Node(instance in=s5) -> ("Indexed Verts"=w71)
                  call "Read Byte.gvi"(error in=s6) -> (Word=w72, error out=w73)
                  Array Index(array=w71) -> (out0[w72]=w74)
                  Property Node(instance in=w74) -> ("x"=w75, "y"=w76)
                  append w75 to w68
                  append w76 to w70
                  next s6 = w73
                }
                w69 = s5
                w5 = s6
              }
              frame False {
                s7 = s2  # shift register
                s8 = w65  # shift register
                for (N = w67) {
                  call "Read Byte.gvi"(error in=s8) -> (Word=w77, error out=w78)
                  call "Read Byte.gvi"(error in=w78) -> (Word=w79, error out=w80)
                  append w77 to w68
                  append w79 to w70
                  next s8 = w80
                }
                w69 = s7
                w5 = s8
              }
            }
            Scale By Power Of 2(n=-4, x=w64) -> w81
            Logical And(0xF, w81) -> w82
            Property Node(instance in=w69) -> ("Plots"=w83)
            Array Index(array=w68) -> (out0[_]=w84)
            # Insert NaN between polygons on same plot to prevent line being drawn between them.
            Array Index(array=w83) -> (out0[w82]=w85)
            Property Node(instance in=w85) -> ("x"=w86, "y"=w87)
            Build Array(w86, w68, w84, NaN) -> w88
            Array Index(array=w70) -> (out0[_]=w89)
            Build Array(w87, w70, w89, NaN) -> w90
            w91 = cluster{"Element 1": f64[], "Element 2": f64[]} {all zero or empty}
            Property Node(instance in=w91, "Element 1"=w88, "Element 2"=w90) -> (instance out=w92)
            Replace Array Subset(inArray=w83, index=w82, new=w92) -> w93
            Property Node(instance in=w69, "Plots"=w93) -> (instance out=w3)
            w94 = "Draw Polygons"  # State
            w4 = w94
          }
          frame 253..255 {
            To Double Precision Float(number=24) -> w95
            Reciprocal(x=w95) -> w96
            Multiply(w96, 1000) -> w97
            To Unsigned 32 Bit Integer(number=w97) -> w98
            Wait(time to wait=w98)
            case (w64) {
              frame Default {
                w99 = "Finish"  # State
                w4 = w99
              }
              frame 255 {
                w100 = "Read Flags"  # State
                w4 = w100
              }
              frame 254 {
                w101 = "Skip 64kB"  # State
                w4 = w101
              }
            }
            w3 = s2
            w5 = w65
          }
        }
        w6 = default
      }
      frame "Skip 64kB" {
        call "Read Bytes from Scene.gvi"(bytes to read=65535) -> (error out=w5)
        w102 = "Read Flags"  # State
        w3 = s2
        w4 = w102
        w6 = default
      }
      frame "Finish" {
        w103 = "Init"  # State
        w3 = s2
        w4 = w103
        w5 = default
        w6 = FALSE
      }
    }
    w104 = "Finish"  # State
    Select(s=w5, t=w104, f=w4) -> w105
    next s1 = w105
    next s2 = w3
    stop if w6
  }
