vi "Read Bytes from Scene.gvi"   [LabVIEW NXG 5.1.0]
inputs:
  "error in": error
  "bytes to read": i32, required
outputs:
  "error out": error
  "bytes": u8[]
panel controls:
  "allbytes": u8[]
uses:
  LoadScene::Load Scene.gvi
diagram:
  s1 = uninitialised  # shift register
  while {
    Is Less Or Equal To 0(x=$"bytes to read") -> w1
    case (w1) {
      frame False, Default {
        Array Subset(array=$allbytes, index0=s1, length0=$"bytes to read") -> w3
        Array Size(array=w3) -> (size(s)=w5)
        Is Equal To 0(x=w5) -> w6
        Select(s=w6, t=error {"status"=TRUE, "code"=80000, "source"="done!"}, f=no error) -> w7
        Merge Errors($"error in", w7) -> (error out=w4)
        Add($"bytes to read", s1) -> w2
      }
      frame True {
        disable {
          frame TARGET_TYPE == "WebServer" {
            case ($"error in") {
              frame Error {
                w8 = u8[] []
                w4 = $"error in"
              }
              frame No Error {
                call "Load Scene.gvi"(error in=$"error in") -> (scene data=w8, error out=w4)
              }
            }
          }
          frame TARGET_TYPE == "Windows", Default {
            Get Component Directory() -> (Path=w9)
            Build Path(base path=w9, name or relative path=path "scene1.bin") -> (appended path=w10)
            Open Or Create Or Replace File(access (0:read/write)="read-only", error in=$"error in", file path (use dialog)=w10) -> (error out=w11, refnum out=w12)
            w13 = u8 0  # U8
            Read From Binary File(count=-1, data type=w13, error in=w11, file (use dialog)=w12) -> (data=w8, error out=w14, refnum out=w15)
            Close File(error in=w14, refnum=w15) -> (error out=w4)
          }
        }
        $allbytes <- w8
        w2 = 0
        w3 = u8[] []
      }
    }
    next s1 = w2
    stop if TRUE
  }
  $bytes <- w3
  $"error out" <- w4
