vi "Rotate Direction.gvi"   [LabVIEW NXG 3.1.0]
inputs:
  "direction in": "Direction.gtype" = "⬆️", required
  "user action": "User Action.gtype" = "rotate ccw", required
outputs:
  "direction out": "Direction.gtype"
types:
  "User Action.gtype" = enum{"rotate ccw", "rotate cw"}
  "Direction.gtype" = enum{"⬆️", "↗️", "➡️", "↘️", "⬇️", "↙️", "⬅️", "↖️"}
diagram:
  case ($"user action") {
    frame "rotate ccw" {
      Is Equal To 0(x=$"direction in") -> w2
      Decrement(x=$"direction in") -> w3
      Select(s=w2, t="↖️", f=w3) -> w1
    }
    frame "rotate cw" {
      Increment(x=$"direction in") -> w4
      Is Equal(x=$"direction in", y="↖️") -> w5
      Select(s=w5, t="⬆️", f=w4) -> w1
    }
    frame Default {
      w1 = $"direction in"
    }
  }
  $"direction out" <- w1
