vi "Entity Get.gvi"   [LabVIEW NXG 3.1.0]
inputs:
  "game state in": "Game State.gtype"
  "enitity index": i32
outputs:
  "entity": "Entity.gtype"
types:
  "Direction.gtype" = enum{"⬆️", "↗️", "➡️", "↘️", "⬇️", "↙️", "⬅️", "↖️"}
  "Edible.gtype" = bool
  "Snake Body.gtype" = bool
  "Entity.gtype" = cluster{"Direction": "Direction.gtype"[], "Edible": "Edible.gtype"[], "Position": "Position.gtype"[], "Snake Body": "Snake Body.gtype"[], "Snake Head": "Snake Head.gtype"[]}
  "Game State.gtype" = cluster{"World Size": cluster{"Width": u32, "Height": u32}, "Entities": "Entity.gtype"[]}
diagram:
  Property Node(instance in=$"game state in") -> ("Entities"=w1)
  Array Index(array=w1) -> (out0[$"enitity index"]=w2)
  $entity <- w2
