vi "Entity Set.gvi"   [LabVIEW NXG 3.1.0]
inputs:
  "game state in": "Game State.gtype"
  "enitity index": i32
  "entity": "Entity.gtype"
outputs:
  "game state out": "Game State.gtype"
types:
  "Direction.gtype" = enum{"⬆️", "↗️", "➡️", "↘️", "⬇️", "↙️", "⬅️", "↖️"}
  "Edible.gtype" = bool
  "Snake Body.gtype" = bool
  "Entity.gtype" = cluster{"Direction": "Direction.gtype"[], "Edible": "Edible.gtype"[], "Position": "Position.gtype"[], "Snake Body": "Snake Body.gtype"[], "Snake Head": "Snake Head.gtype"[]}
  "Game State.gtype" = cluster{"World Size": cluster{"Width": u32, "Height": u32}, "Entities": "Entity.gtype"[]}
diagram:
  Property Node(instance in=$"game state in") -> ("Entities"=w1, instance out=w2)
  Replace Array Subset(inArray=w1, index=$"enitity index", new=$entity) -> w3
  Property Node(instance in=w2, "Entities"=w3) -> (instance out=w4)
  $"game state out" <- w4
