vi "Append Head.gvi"   [LabVIEW NXG 3.1.0]
inputs:
  "position": "Position.gtype"
  "game state in": "Game State.gtype"
outputs:
  "game state out": "Game State.gtype"
types:
  "Position.gtype" = cluster{"X": i32, "Y": i32}
  "Direction.gtype" = enum{"⬆️", "↗️", "➡️", "↘️", "⬇️", "↙️", "⬅️", "↖️"}
  "Edible.gtype" = bool
  "Snake Body.gtype" = bool
  "Entity.gtype" = cluster{"Direction": "Direction.gtype"[], "Edible": "Edible.gtype"[], "Position": "Position.gtype"[], "Snake Body": "Snake Body.gtype"[], "Snake Head": "Snake Head.gtype"[]}
  "User Action.gtype" = enum{"rotate ccw", "rotate cw"}
  "Game State.gtype" = cluster{"World Size": cluster{"Width": u32, "Height": u32}, "Entities": "Entity.gtype"[], "User Actions": Queue<"User Action.gtype">}
  "Snake Head.gtype" = cluster{"Snake Body Entities Index": i32[]}
diagram:
  Property Node(instance in=$"game state in") -> ("Entities"=w1, instance out=w2)
  Build Array("Snake Head.gtype" {all zero or empty}) -> w3
  Build Array($position) -> w4
  Property Node(instance in="Entity.gtype" {all zero or empty}, "Snake Head"=w3, "Position"=w4, "Direction"=["⬆️"]) -> (instance out=w5)
  Build Array(w1, w5) -> w6
  Property Node(instance in=w2, "Entities"=w6) -> (instance out=w7)
  $"game state out" <- w7
