vi "Initialization System.gvi"   [LabVIEW NXG 3.1.0]
outputs:
  "game state out": "Game State.gtype"
types:
  "Direction.gtype" = enum{"⬆️", "↗️", "➡️", "↘️", "⬇️", "↙️", "⬅️", "↖️"}
  "Edible.gtype" = bool
  "Snake Body.gtype" = bool
  "Entity.gtype" = cluster{"Direction": "Direction.gtype"[], "Edible": "Edible.gtype"[], "Position": "Position.gtype"[], "Snake Body": "Snake Body.gtype"[], "Snake Head": "Snake Head.gtype"[]}
  "User Action.gtype" = enum{"rotate ccw", "rotate cw"}
  "Game State.gtype" = cluster{"World Size": cluster{"Width": u32, "Height": u32}, "Entities": "Entity.gtype"[], "User Actions": Queue<"User Action.gtype">}
  "Position.gtype" = cluster{"X": i32, "Y": i32}
uses:
  Snek::Entity Components::Snake Head::Append Head.gvi
  Snek::SubVIs::Grow Snake Body.gvi
diagram:
  Property Node(instance in="Position.gtype" {all zero or empty}, "X"=500, "Y"=500) -> (instance out=w1)
  Obtain Queue(element data type="User Action.gtype" "rotate ccw") -> (queue out=w2)
  Property Node(instance in="Game State.gtype" {all zero or empty}, "World Size:Width"=1000, "World Size:Height"=1000, "User Actions"=w2) -> (instance out=w3)
  call "Append Head.gvi"(game state in=w3, position=w1) -> (game state out=w4)
  call "Grow Snake Body.gvi"(game state in=w4, position=w1, number of body segments=50) -> (game state out=w5)
  $"game state out" <- w5
