vi "Process User Input System.gvi"   [LabVIEW NXG 3.1.0]
inputs:
  "game state in": "Game State.gtype", required
outputs:
  "game state out": "Game State.gtype"
types:
  "Direction.gtype" = enum{"⬆️", "↗️", "➡️", "↘️", "⬇️", "↙️", "⬅️", "↖️"}
  "Edible.gtype" = bool
  "Snake Body.gtype" = bool
  "Entity.gtype" = cluster{"Direction": "Direction.gtype"[], "Edible": "Edible.gtype"[], "Position": "Position.gtype"[], "Snake Body": "Snake Body.gtype"[], "Snake Head": "Snake Head.gtype"[]}
  "User Action.gtype" = enum{"rotate ccw", "rotate cw"}
  "Game State.gtype" = cluster{"World Size": cluster{"Width": u32, "Height": u32}, "Entities": "Entity.gtype"[], "User Actions": Queue<"User Action.gtype">}
uses:
  Snek::SubVIs::Snake Head Index.gvi
  Snek::Entity Components::Direction::Rotate Direction.gvi
diagram:
  Property Node(instance in=$"game state in") -> ("User Actions"=w1, instance out=w2)
  s1 = w2  # shift register
  while {
    Dequeue Element(queue=w1, timeout in ms=0) -> (element=w3, timed out?=w4)
    case (w4) {
      frame False, Default {
        call "Snake Head Index.gvi"() -> (Index=w6)
        call "Rotate Direction.gvi"(game state in=s1, entity index in=w6, user action=w3) -> (game state out=w5)
      }
      frame True {
        w5 = s1
      }
    }
    next s1 = w5
    stop if w4
  }
  $"game state out" <- s1
