vi "Snake Move System.gvi"   [LabVIEW NXG 3.1.0]
inputs:
  "game state in": "Game State.gtype", required
outputs:
  "game state out": "Game State.gtype"
types:
  "Direction.gtype" = enum{"⬆️", "↗️", "➡️", "↘️", "⬇️", "↙️", "⬅️", "↖️"}
  "Edible.gtype" = bool
  "Snake Body.gtype" = bool
  "Entity.gtype" = cluster{"Direction": "Direction.gtype"[], "Edible": "Edible.gtype"[], "Position": "Position.gtype"[], "Snake Body": "Snake Body.gtype"[], "Snake Head": "Snake Head.gtype"[]}
  "User Action.gtype" = enum{"rotate ccw", "rotate cw"}
  "Game State.gtype" = cluster{"World Size": cluster{"Width": u32, "Height": u32}, "Entities": "Entity.gtype"[], "User Actions": Queue<"User Action.gtype">}
uses:
  Snek::SubVIs::Snake Head Index.gvi
  Snek::Entity Components::Direction::Direction Get.gvi
  Snek::Entity Components::Position::Translate Position.gvi
diagram:
  call "Snake Head Index.gvi"() -> (Index=w1)
  call "Direction Get.gvi"(game state in=$"game state in", entity index in=w1) -> (game state out=w2, enitity index out=w3, direction=w4)
  call "Translate Position.gvi"(game state in=w2, entity index in=w3, direction=w4) -> (game state out=w5)
  $"game state out" <- w5
