vi "index.gviweb"   [LabVIEW NXG 3.1.0]
panel controls:
  "Button": bool
  "Button_2": bool
panel indicators:
  "Snake Game": cluster{"X": i32[], "Y": i32[]}[]
  "X": i32[]
  "Y": i32[]
uses:
  WebApp::Systems::Initialization System.gvi
  WebApp::Systems::Snake Move System.gvi
  WebApp::Systems::Render System.gvi
  WebApp::SubVIs::Snake Head Index.gvi
diagram:
  call "Initialization System.gvi"() -> (game state out=w1)
  s1 = w1  # shift register
  while {
    Wait(time to wait=10)
    call "Snake Move System.gvi"(game state in=s1) -> (game state out=w2)
    call "Render System.gvi"(game state in=w2) -> (game state rendered=w3)
    $"Snake Game" <- w3
    call "Snake Head Index.gvi"() -> (Index=w4)
    Array Index(array=w3) -> (out0[w4]=w5)
    Property Node(instance in=w5) -> ("X"=w6, "Y"=w7)
    $X <- w6
    $Y <- w7
    next s1 = w2
    stop if FALSE
  }
