vi "Animation Mixer.gvi"   [LabVIEW NXG 3.1.0]
inputs:
  "entity attributes in": "entity attributes.gtype"
outputs:
  "entity attributes out": "entity attributes.gtype"
types:
  "property value config.gtype" = cluster{"type": string, "propertyValueJSON": string}
  "property value configs.gtype" = "property value config.gtype"[]
  "attribute value config.gtype" = cluster{"attributeValue": string, "exists": bool}
  "attribute value configs.gtype" = "attribute value config.gtype"[]
  "entity attributes.gtype" = cluster{"property names": string[], "property value configs": "property value configs.gtype", "attribute names": string[], "attribute value configs": "attribute value configs.gtype"}
uses:
  DOM::Shared::Append Attribute Value Config.gvi
diagram:
  Property Node(instance in=$"entity attributes in") -> ("attribute names"=w1, "attribute value configs"=w2, instance out=w3)
  Build Array(w1, "animation-mixer") -> w4
  call "Append Attribute Value Config.gvi"(attribute value configs in=w2, attribute value="loop:repeat;timeScale:.5;") -> (attribute value configs out=w5)
  Property Node(instance in=w3, "attribute names"=w4, "attribute value configs"=w5) -> (instance out=w6)
  $"entity attributes out" <- w6
