vi "Position.gvi"   [LabVIEW NXG 3.1.0]
inputs:
  "entity attributes in": "entity attributes.gtype"
  "x": f64, required
  "y": f64, required
  "z": f64, required
outputs:
  "entity attributes out": "entity attributes.gtype"
types:
  "attribute.gtype" = cluster{"name": string, "valueJSON": string}
  "entity attributes.gtype" = "attribute.gtype"[]
  T1 = cluster{"data": cluster{"x": f64, "y": f64, "z": f64}}
uses:
  AugmentedReality::Support::Append Attribute.gvi
diagram:
  disable {
    frame Enabled { }
    frame Disabled {
      # Not sure why this formt does not work
      Property Node(instance in=T1 {all zero or empty})
    }
  }
  Format Into String(formatString="%f %f %f", $x, $y, $z) -> w1
  Property Node(instance in=cluster{"data": string} {all zero or empty}, "data"=w1) -> (instance out=w2)
  Flatten To JSON(anything=w2) -> (JSON string=w3)
  call "Append Attribute.gvi"(entity attributes in=$"entity attributes in", name="position", valueJSON=w3) -> (entity attributes out=w4)
  $"entity attributes out" <- w4
