vi "Rotation.gvi"   [LabVIEW NXG 3.1.0]
inputs:
  "entity attributes in": "entity attributes.gtype"
  "x": f64
  "y": f64
  "z": f64
outputs:
  "entity attributes out": "entity attributes.gtype"
types:
  "attribute.gtype" = cluster{"name": string, "valueJSON": string}
  "entity attributes.gtype" = "attribute.gtype"[]
uses:
  AugmentedReality::Support::Append Attribute.gvi
diagram:
  Format Into String(formatString="%f %f %f", $x, $y, $z) -> w1
  Property Node(instance in=cluster{"data": string} {all zero or empty}, "data"=w1) -> (instance out=w2)
  Flatten To JSON(anything=w2) -> (JSON string=w3)
  call "Append Attribute.gvi"(entity attributes in=$"entity attributes in", name="rotation", valueJSON=w3) -> (entity attributes out=w4)
  $"entity attributes out" <- w4
