vi "Create GLTF Model.gviweb"   [LabVIEW NXG 3.1.0]
inputs:
  "src": string, required
  "attributes": cluster{"name": string, "value": string}[]
  "error in": error
  "scene reference": "scene reference.gtype", required
outputs:
  "error out": error
  "gltf model reference": "gltf model reference.gtype"
types:
  "gltf model reference.gtype" = u32
  "scene reference.gtype" = i32
uses:
  AugmentedReality::Support::AugmentedReality.jsli::CreateGLTFModel
diagram:
  Flatten To JSON(anything=$attributes) -> (JSON string=w1)
  call "CreateGLTFModel"(scene reference=$"scene reference", src=$src, attributesJSON=w1, error in=$"error in") -> (gltf model reference=w2, error out=w3)
  $"gltf model reference" <- w2
  $"error out" <- w3
