vi "Set Model Height.gviweb"   [LabVIEW NXG 3.1.0]
inputs:
  "gltf model reference": "entity reference.gtype"
  "height": u32
  "error in": error
outputs:
  "error out": error
types:
  "entity reference.gtype" = u32
uses:
  AugmentedReality::Entity Attributes::Position.gvi
  AugmentedReality::Entity::Update Entity.gviweb
diagram:
  call "Position.gvi"(x=0, y=$height, z=0) -> (entity attributes out=w1)
  call "Update Entity.gviweb"(entity reference in=$"gltf model reference", entity attributes=w1, error in=$"error in") -> (error out=w2)
  $"error out" <- w2
