vi "Create Navbar.gvi"   [LabVIEW NXG 3.1.0]
inputs:
  "error in": error
outputs:
  "error out": error
uses:
  Bootstrap::Load Bootstrap.gvi
  Navigation::Get Web Application Directory Url.gvi
  Navigation::Insert Html Before Front Panel Wrapper.gvi
diagram:
  w1 = """<nav class="navbar navbar-expand-md navbar-dark bg-dark">
    <a class="navbar-brand" href="%sindex.html">Fixed navbar</a>
    <button class="navbar-toggler" type="button" data-toggle="collapse" data-target="#webviNavbar" aria-controls="webviNavbar" aria-expanded="false" aria-label="Toggle navigation">
        <span class="navbar-toggler-icon"></span>
    </button>
    <div class="collapse navbar-collapse" id="webviNavbar">
        <ul class="navbar-nav mr-auto">
            <li class="nav-item active">
                <a class="nav-link" href="#">Home <span class="sr-only">(current)</span></a>
            </li>
            <li class="nav-item">
                <a class="nav-link" href="#">Link</a>
            </li>
            <li class="nav-item">
                <a class="nav-link disabled" href="#">Disabled</a>
            </li>
        </ul>
    </div>
</nav>
"""
  call "Load Bootstrap.gvi"(error in=$"error in") -> (error out=w2)
  call "Get Web Application Directory Url.gvi"(error in=w2) -> (web application directory url=w3, error out=w4)
  Format Into String(formatString=w1, errIn=w4, w3) -> (outString=w5, errOut=w6)
  call "Insert Html Before Front Panel Wrapper.gvi"(html to insert=w5, error in=w6) -> (error out=w7)
  $"error out" <- w7
