vi "Create Document Fragment.gvi"   [LabVIEW NXG 5.0.0]
inputs:
  "content": string, required
  "inert?": bool = TRUE
  "error in": error
  "document target reference (global document)": "dom reference.gtype"
outputs:
  "error out": error
  "document fragment reference": "dom reference.gtype"
types:
  "dom reference.gtype" = "NI.JavaScriptReference"
uses:
  DOM::Support::Default or Global.gvi
  DOM::Support::DOM.jsli::CreateDocumentFragment
diagram:
  call "Default or Global.gvi"(input target=$"document target reference (global document)") -> (document=w1)
  call "CreateDocumentFragment"(documentTarget=w1, content=$content, isInert=$"inert?", error in=$"error in") -> (documentFragment=w2, error out=w3)
  $"document fragment reference" <- w2
  $"error out" <- w3
