vi "Create Elements.gvi"   [LabVIEW NXG 3.1.0]
inputs:
  "tag names": string[], required
  "error in": error
  "document target": i32
outputs:
  "element references": "dom reference.gtype"[]
  "error out": error
types:
  "dom reference.gtype" = i32
uses:
  DOM::Support::DOM.jsli::CreateElements
diagram:
  Flatten To JSON(anything=$"tag names") -> (JSON string=w1)
  call "CreateElements"(documentTargetReference=$"document target", tagNamesJSON=w1, error in=$"error in") -> (elementReferences=w2, error out=w3)
  $"element references" <- w2
  $"error out" <- w3
