vi "Get Attributes.gvi"   [LabVIEW NXG 4.0.0]
inputs:
  "element reference in": "dom reference.gtype", required
  "attribute names in": string[]
  "error in": error
outputs:
  "error out": error
  "element reference out": "dom reference.gtype"
  "dom values": "dom values.gtype"
types:
  "dom reference.gtype" = i32
  "dom value type.gtype" = enum{"unknown", "attribute", "absent", "undefined", "boolean", "number", "string"}
  "dom value.gtype" = cluster{"type": "dom value type.gtype", "name": string, "value": string}
  "dom values.gtype" = "dom value.gtype"[]
uses:
  DOM::Support::DOM.jsli::GetAttributes
  DOM::Support::DOM Values from JSON.gvi
diagram:
  $"element reference out" <- $"element reference in"
  Flatten To JSON(anything=$"attribute names in") -> (JSON string=w1)
  call "GetAttributes"(elementReference=$"element reference in", attributeNamesJSON=w1, error in=$"error in") -> (attributeValueResultsJSON=w2, error out=w3)
  call "DOM Values from JSON.gvi"(json=w2, error in=w3) -> (dom values=w4, error out=w5)
  $"dom values" <- w4
  $"error out" <- w5
