vi "Parse Style Attribute Value.gvi"   [LabVIEW NXG 3.1.0]
panel controls:
  "attribute value string": string
panel indicators:
  "style property names": string[]
  "style property values": string[]
uses:
  NI::G Core::Strings::Trim Whitespace.gvi
diagram:
  w1 = string[] []  # style property names
  w2 = string[] []  # style property values
  s1 = $"attribute value string"  # shift register
  s2 = w1  # shift register
  s3 = w2  # shift register
  while {
    Match Pattern(regular expression=";", string=s1) -> (after substring=w3, before substring=w4)
    Match Pattern(regular expression=":", string=w4) -> (after substring=w5, before substring=w6, offset past match=w7)
    Is Not Equal(x=w7, y=-1) -> w8
    case (w8) {
      frame False, Default {
        w9 = s2
        w10 = s3
      }
      frame True {
        call "Trim Whitespace.gvi"(string=w6) -> (trimmed string=w11)
        Build Array(s2, w11) -> w9
        call "Trim Whitespace.gvi"(string=w5) -> (trimmed string=w12)
        Build Array(s3, w12) -> w10
      }
    }
    String Length(string=w3) -> (length=w13)
    Is Equal To 0(x=w13) -> w14
    next s1 = w3
    next s2 = w9
    next s3 = w10
    stop if w14
  }
  $"style property names" <- s2
  $"style property values" <- s3
