vi "Invoke Element Method.gvi"   [LabVIEW NXG 3.1.0]
inputs:
  "error in": error
  "element reference": "dom reference.gtype", required
  "method name": string, required
  "parameter property value configs": "property value configs.gtype"
outputs:
  "error out": error
  "return value property value config": "property value configs.gtype"
types:
  "dom reference.gtype" = i32
  "property value config.gtype" = cluster{"type": string, "propertyValueJSON": string}
  "property value configs.gtype" = "property value config.gtype"[]
uses:
  DOM::Support::DOM.jsli::InvokeElementMethod
diagram:
  Flatten To JSON(anything=$"parameter property value configs") -> (JSON string=w1)
  call "InvokeElementMethod"(elementReference=$"element reference", methodName=$"method name", parameterPropertyValueConfigsJSON=w1, error in=$"error in") -> (returnValuePropertyValueConfigJSON=w2, error out=w3)
  Unflatten From JSON(JSON string=w2, type and defaults="property value configs.gtype" []) -> (value=w4)
  $"return value property value config" <- w4
  $"error out" <- w3
