vi "Query Selector All.gvi"   [LabVIEW NXG 3.1.0]
inputs:
  "selector": string, required
  "document reference": "dom reference.gtype"
  "error in": error
outputs:
  "error out": error
  "element references": "dom reference.gtype"[]
types:
  "dom reference.gtype" = i32
uses:
  DOM::Support::DOM.jsli::QuerySelectorAll
diagram:
  call "QuerySelectorAll"(selector=$selector, documentTargetReference=$"document reference", error in=$"error in") -> (elementReferencesJSON=w1, error out=w2)
  Unflatten From JSON(JSON string=w1, type and defaults="dom reference.gtype"[] []) -> (value=w3)
  $"element references" <- w3
  $"error out" <- w2
