vi "Query Selectors.gvi"   [LabVIEW NXG 3.1.0]
inputs:
  "error in": error
  "selectors": string[], required
  "document target": "dom reference.gtype"
outputs:
  "element references": "dom reference.gtype"[]
  "error out": error
types:
  "dom reference.gtype" = i32
uses:
  DOM::Support::DOM.jsli::QuerySelectors
diagram:
  Flatten To JSON(anything=$selectors) -> (JSON string=w1)
  call "QuerySelectors"(documentTargetReference=$"document target", selectorsJSON=w1, error in=$"error in") -> (elementReferences=w2, error out=w3)
  $"element references" <- w2
  $"error out" <- w3
