vi "Select Element and Append Content.gvi"   [LabVIEW NXG 5.0.0]
inputs:
  "error in": error
  "parent selector": string, required
  "child dom reference in": "dom reference.gtype", required
  "parent document target reference (global document)": "dom reference.gtype"
  "clear parent content": bool
outputs:
  "error out": error
  "child dom reference out": "dom reference.gtype"
types:
  "dom reference.gtype" = "NI.JavaScriptReference"
uses:
  DOM::Search::Query Selectors.gvi
  DOM::Build::Append Children.gvi
diagram:
  Build Array($"parent selector") -> w1
  call "Query Selectors.gvi"(dom target reference in (global document)=$"parent document target reference (global document)", selectors=w1, error in=$"error in") -> (element references=w2, error out=w3)
  Array Index(array=w2) -> (out0[_]=w4)
  Build Array($"child dom reference in") -> w5
  call "Append Children.gvi"(parent reference in=w4, child references=w5, clear parent content=$"clear parent content", error in=w3) -> (parent reference out=w6, error out=w7)
  Close Reference(error in=w7, reference=w6) -> (error out=w8)
  $"error out" <- w8
  $"child dom reference out" <- $"child dom reference in"
