vi "Append Attribute.gvi"   [LabVIEW NXG 4.0.0]
inputs:
  "dom values in": "dom values.gtype"
  "name": string, required
  "value": string
outputs:
  "dom values out": "dom values.gtype"
types:
  "dom value type.gtype" = enum{"unknown", "attribute", "absent", "undefined", "boolean", "number", "string"}
  "dom value.gtype" = cluster{"type": "dom value type.gtype", "name": string, "value": string}
  "dom values.gtype" = "dom value.gtype"[]
diagram:
  Property Node(instance in="dom value.gtype" {all zero or empty}, "name"=$name, "value"=$value, "type"="attribute") -> (instance out=w1)
  Build Array($"dom values in", w1) -> w2
  $"dom values out" <- w2
