vi "aframe.gviweb"   [LabVIEW NXG 3.1.0]
panel controls:
  "Slider": f64
uses:
  DOM::Tasks::Create Document Fragment.gvi
  DOM::Tasks::Select Element and Replace Contents.gvi
  DOM::Shared::Append Property Value Config as Double.gvi
  DOM::Configure::Set Properties.gvi
diagram:
  w1 = """    <a-scene background="color: #FAFAFA" embedded>
      <a-box position="-1 0.5 -3" rotation="0 45 0" color="#4CC3D9" shadow></a-box>
      <a-sphere position="0 1.25 -5" radius="1.25" color="#EF2D5E" shadow></a-sphere>
      <a-cylinder position="1 0.75 -3" radius="0.5" height="1.5" color="#FFC65D" shadow></a-cylinder>
      <a-plane position="0 0 -4" rotation="-90 0 0" width="4" height="4" color="#7BC8A4" shadow></a-plane>
    </a-scene>"""
  call "Create Document Fragment.gvi"(fragment content=w1, selectors=["a-box", "a-sphere", "a-cylinder"]) -> (fragment reference=w2, element references=w3, error out=w4)
  call "Select Element and Replace Contents.gvi"(parent selector=".my-vr-scene", dom reference=w2, error in=w4)
  Array Index(array=w3) -> (out0[_]=w5)
  while {
    Wait(time to wait=10)
    call "Append Property Value Config as Double.gvi"(value=$Slider) -> (property value configs out=w6)
    call "Set Properties.gvi"(element reference in=w5, property names=["object3D.rotation.x"], property value configs=w6)
    stop if FALSE
  }
