vi "index.gviweb"   [LabVIEW NXG 4.0.0]
panel indicators:
  "name": string[]
  "value": string[]
  "found": bool[]
  "name_2": string[]
  "value_2": string[]
  "found_2": bool[]
  "iframe load time": timestamp
  "iframe load time_2": timestamp
uses:
  DOM::Search::Query Selectors.gvi
  DOM::Build::Create Document Fragment.gvi
  DOM::Build::Append Children.gvi
  DOM::Values::Append Attribute.gvi
  DOM::Configure::Set Attributes and Properties.gvi
  DOM::Configure::Get Attributes.gvi
  DOM::Values::Get Attribute.gvi
  DOM::Monitor::Add Event Listener.gvi
  DOM::Monitor::Wait For Event.gvi
  DOM::Monitor::Remove Event Listener.gvi
  DOM::Tasks::Select Element and Append Content.gvi
diagram:
  Build Array(".placeholder") -> w1
  call "Query Selectors.gvi"(selectors=w1) -> (element references=w2)
  Array Index(array=w2) -> (out0[_]=w3)
  while (after w3) {
    Wait(time to wait=50)
    stop if FALSE
  }
  call "Create Document Fragment.gvi"(content="<iframe random=\"lol\"></iframe>") -> (document fragment reference=w4)
  call "Query Selectors.gvi"(dom target reference in (global document)=w4, selectors=["iframe"]) -> (dom target reference out=w5, element references=w6)
  Build Array(w5) -> w7
  call "Append Children.gvi"(parent reference in=w3, child references=w7, clear parent content=TRUE)
  Array Index(array=w6) -> (out0[_]=w8)
  call "Append Attribute.gvi"(name="src", value="http://www.ni.com") -> (dom values out=w9)
  call "Set Attributes and Properties.gvi"(element reference in=w8, dom values=w9) -> (element reference out=w10)
  call "Get Attributes.gvi"(element reference in=w10) -> (dom values=w11)
  Array Size(array=w11) -> (size(s)=w12)
  for (N = w12) (iteration -> i1) {
    call "Get Attribute.gvi"(dom values in=w11, index=i1) -> (name=w16, value=w17, exists=w18)
    append w16 to w13
    append w17 to w14
    append w18 to w15
  }
  $found <- w15
  $name <- w13
  $value <- w14
  call "Get Attributes.gvi"(element reference in=w10, attribute names in=["random", "fakenews"]) -> (dom values=w19)
  Array Size(array=w19) -> (size(s)=w20)
  for (N = w20) (iteration -> i2) {
    call "Get Attribute.gvi"(dom values in=w19, index=i2) -> (name=w24, value=w25, exists=w26)
    append w24 to w21
    append w25 to w22
    append w26 to w23
  }
  $found_2 <- w23
  $name_2 <- w21
  $value_2 <- w22
  call "Add Event Listener.gvi"(element reference in=w10, event name="load") -> (event manager reference=w27, error out=w28)
  call "Wait For Event.gvi"(event manager reference in=w27, error in=w28) -> (event manager reference out=w29, error out=w30)
  sequence {
    frame 0 {
      Get Current Time() -> (current time=w31)
      $"iframe load time" <- w31
    }
  }
  call "Remove Event Listener.gvi"(event manager reference=w29, error in=w30)
  call "Create Document Fragment.gvi"(content="<iframe src=\"https://www.reddit.com\"></iframe>") -> (document fragment reference=w32, error out=w33)
  call "Query Selectors.gvi"(dom target reference in (global document)=w32, selectors=["iframe"], error in=w33) -> (element references=w34, error out=w35)
  Array Index(array=w34) -> (out0[_]=w36)
  call "Add Event Listener.gvi"(element reference in=w36, event name="load", error in=w35) -> (element reference out=w37, event manager reference=w38, error out=w39)
  call "Select Element and Append Content.gvi"(parent selector=".placeholder2", child dom reference in=w37, clear parent content=TRUE, error in=w39) -> (error out=w40)
  call "Wait For Event.gvi"(event manager reference in=w38, error in=w40) -> (dom values=w41)
  sequence (after w41) {
    frame 0 {
      Get Current Time() -> (current time=w42)
      $"iframe load time_2" <- w42
    }
  }
