vi "svg.gviweb"   [LabVIEW NXG 5.0.0]
uses:
  DOM::Build::HTML Placeholder Container to DOM Reference.gvi
  DOM::Build::Create Document Fragment.gvi
  DOM::Build::Append Children.gvi
  DOM::Build::Create Elements.gvi
  DOM::Values::Append Attribute.gvi
  DOM::Configure::Set Attributes and Properties.gvi
  DOM::Search::Query Selector All.gvi
diagram:
  call "HTML Placeholder Container to DOM Reference.gvi"(container=reference to "HTML Container") -> (element reference=w1)
  w2 = """<svg height="100" width="100">
  <circle cx="50" cy="50" r="40" stroke="black" stroke-width="3" fill="red" />
  <image xlink:href="https://mdn.mozillademos.org/files/6457/mdn_logo_only_color.png" height="200" width="200"/>
</svg>"""
  call "Create Document Fragment.gvi"(content=w2) -> (document fragment reference=w3)
  Build Array(w3) -> w4
  call "Append Children.gvi"(parent reference in=w1, child references=w4, clear parent content=TRUE)
  call "HTML Placeholder Container to DOM Reference.gvi"(container=reference to "HTML Container_2") -> (element reference=w5)
  call "Create Elements.gvi"(tag names=["svg"]) -> (element references=w6)
  Array Index(array=w6) -> (out0[_]=w7)
  call "Append Attribute.gvi"(name="height", value="100") -> (dom values out=w8)
  call "Append Attribute.gvi"(dom values in=w8, name="width", value="100") -> (dom values out=w9)
  call "Set Attributes and Properties.gvi"(element reference in=w7, dom values=w9) -> (element reference out=w10)
  # Todo can't use setAttribute because need xlink namespace, this is a workaround
  # Todo can't use createElement because need a way to pass the namespace, this is a workaround
  call "Create Document Fragment.gvi"(content="<svg><image xlink:href=\"\"/></svg>") -> (document fragment reference=w11)
  call "Query Selector All.gvi"(dom target reference in (global document)=w11, selector="image") -> (element references=w12)
  Array Index(array=w12) -> (out0[_]=w13)
  w14 = "https://mdn.mozillademos.org/files/6457/mdn_logo_only_color.png"
  call "Append Attribute.gvi"(name="width", value="200") -> (dom values out=w15)
  call "Append Attribute.gvi"(dom values in=w15, name="height", value="200") -> (dom values out=w16)
  call "Append Attribute.gvi"(dom values in=w16, name="xlink:href", value=w14) -> (dom values out=w17)
  call "Set Attributes and Properties.gvi"(element reference in=w13, dom values=w17) -> (element reference out=w18)
  # This works because the circle element is created inside an svg context in the document fragment. If it was created outside via createElements or as a circle tag standalone it would be in the html context and fail to work.
  call "Create Document Fragment.gvi"(content="<svg><circle/></svg>") -> (document fragment reference=w19)
  call "Query Selector All.gvi"(dom target reference in (global document)=w19, selector="circle") -> (element references=w20)
  Array Index(array=w20) -> (out0[_]=w21)
  # Todo can't use createElement because need a way to pass the namespace, this is a workaround
  call "Append Attribute.gvi"(name="cx", value="50") -> (dom values out=w22)
  call "Append Attribute.gvi"(dom values in=w22, name="cy", value="50") -> (dom values out=w23)
  call "Append Attribute.gvi"(dom values in=w23, name="r", value="40") -> (dom values out=w24)
  call "Append Attribute.gvi"(dom values in=w24, name="stroke", value="black") -> (dom values out=w25)
  call "Append Attribute.gvi"(dom values in=w25, name="stroke-width", value="3") -> (dom values out=w26)
  call "Append Attribute.gvi"(dom values in=w26, name="fill", value="red") -> (dom values out=w27)
  call "Append Attribute.gvi"(dom values in=w27, name="pathLength", value="7") -> (dom values out=w28)
  call "Set Attributes and Properties.gvi"(element reference in=w21, dom values=w28) -> (element reference out=w29)
  Build Array(w29, w18) -> w30
  call "Append Children.gvi"(parent reference in=w10, child references=w30) -> (parent reference out=w31)
  Build Array(w31) -> w32
  call "Append Children.gvi"(parent reference in=w5, child references=w32, clear parent content=TRUE)
  while {
    stop if FALSE
  }
