vi "DataGrid - String Column - Text Match.gvi"   [LabVIEW NXG 5.1.0]
inputs:
  "text match options": "text match options.gtype", required
  "selector": string, required
  "column index": u32, required
outputs:
  "rule selector": "rule selector.gtype"
types:
  "operator.gtype" = enum{"exact match", "starts with", "ends with", "contains"}
  "text match options.gtype" = cluster{"operator": "operator.gtype", "text": string, "case-insensitive": bool}
  "rule selector.gtype" = cluster{"type": string, "configJSON": string}
  T1 = cluster{"selector": string, "index": i32, "operator": string, "text": string, "caseInsensitive": bool}
diagram:
  w1 = "rule selector.gtype" {"type"="datagrid-stringcolumn-textmatch", "configJSON"=""}
  Property Node(instance in=$"text match options") -> ("operator"=w2, "text"=w3, "case-insensitive"=w4)
  Format Into String(w2) -> w5
  Property Node(instance in=T1 {all zero or empty}, "selector"=$selector, "index"=$"column index", "operator"=w5, "text"=w3, "caseInsensitive"=w4) -> (instance out=w6)
  Flatten To Json(anything=w6) -> (JSON string=w7)
  Property Node(instance in=w1, "configJSON"=w7) -> (instance out=w8)
  $"rule selector" <- w8
