vi "errors.gviweb"   [LabVIEW NXG 5.1.0]
panel controls:
  "Data Grid": cluster{"String": string, "Numeric": f64}[]
  "String": string
panel indicators:
  "non-existing element": error
  "non-existant column": error
  "non-datagrid element": error
  "unexpected column type": error
types:
  "operator.gtype" = enum{"exact match", "starts with", "ends with", "contains"}
  "text match options.gtype" = cluster{"operator": "operator.gtype", "text": string}
uses:
  DeclarativeStyle::Selector::DataGrid - String Column - Text Match.gvi
  DeclarativeStyle::Property::Background Color.gvi
  DeclarativeStyle::Create Style.gvi
diagram:
  w1 = "text match options.gtype" {"operator"="exact match", "text"="pass"}
  call "DataGrid - String Column - Text Match.gvi"(selector=".non-existant-element", column index=0, text match options=w1) -> (rule selector=w2)
  call "Background Color.gvi"(background color=1711318607) -> (rule properties out=w3)
  call "Create Style.gvi"(rule selector=w2, rule properties=w3) -> (error out=w4)
  $"non-existing element" <- w4
  w5 = "text match options.gtype" {"operator"="exact match", "text"="pass"}
  call "DataGrid - String Column - Text Match.gvi"(selector=".non-datagrid-element", column index=0, text match options=w5) -> (rule selector=w6)
  call "Background Color.gvi"(background color=1711318607) -> (rule properties out=w7)
  call "Create Style.gvi"(rule selector=w6, rule properties=w7) -> (error out=w8)
  $"non-datagrid element" <- w8
  w9 = "text match options.gtype" {"operator"="exact match", "text"="pass"}
  call "DataGrid - String Column - Text Match.gvi"(selector=".my-element", column index=20, text match options=w9) -> (rule selector=w10)
  call "Background Color.gvi"(background color=1711318607) -> (rule properties out=w11)
  call "Create Style.gvi"(rule selector=w10, rule properties=w11) -> (error out=w12)
  $"non-existant column" <- w12
  w13 = "text match options.gtype" {"operator"="exact match", "text"="pass"}
  call "DataGrid - String Column - Text Match.gvi"(selector=".my-element", column index=1, text match options=w13) -> (rule selector=w14)
  call "Background Color.gvi"(background color=1711318607) -> (rule properties out=w15)
  call "Create Style.gvi"(rule selector=w14, rule properties=w15) -> (error out=w16)
  $"unexpected column type" <- w16
