vi "index.gviweb"   [LabVIEW NXG 5.1.0]
panel controls:
  "Highlight text": T1[]
  "stop": bool
types:
  T1 = cluster{"Highlight pass and fail exact": string, "Highlight fail contains": string}
  "operator.gtype" = enum{"exact match", "starts with", "ends with", "contains"}
  "text match options.gtype" = cluster{"operator": "operator.gtype", "text": string}
uses:
  DeclarativeStyle::Selector::DataGrid - String Column - Text Match.gvi
  DeclarativeStyle::Property::Background Color.gvi
  DeclarativeStyle::Create Style.gvi
  DeclarativeStyle::Property::Custom Property.gvi
  DeclarativeStyle::Property::Font Color.gvi
  DeclarativeStyle::Remove Style.gvi
  WebApp::Support::Show Error Dialog.gvi
diagram:
  w1 = "text match options.gtype" {"operator"="exact match", "text"="pass"}
  call "DataGrid - String Column - Text Match.gvi"(selector=".my-element", column index=0, text match options=w1) -> (rule selector=w2)
  call "Background Color.gvi"(background color=4289451121) -> (rule properties out=w3)
  call "Create Style.gvi"(rule selector=w2, rule properties=w3) -> (style reference=w4, error out=w5)
  w6 = "text match options.gtype" {"operator"="exact match", "text"="fail"}
  call "DataGrid - String Column - Text Match.gvi"(selector=".my-element", column index=0, text match options=w6) -> (rule selector=w7)
  call "Background Color.gvi"(background color=4294142798) -> (rule properties out=w8)
  call "Create Style.gvi"(rule selector=w7, rule properties=w8) -> (style reference=w9, error out=w10)
  w11 = "text match options.gtype" {"operator"="contains", "text"="fail"}
  call "DataGrid - String Column - Text Match.gvi"(selector=".my-element", column index=1, text match options=w11) -> (rule selector=w12)
  w13 = "linear-gradient( -10deg, #f10d5e 0%, #ffb43e 25%, #43e03c 50%, #6528ff 100%);"
  call "Custom Property.gvi"(name="background-image", value=w13) -> (rule properties out=w14)
  call "Font Color.gvi"(rule properties in=w14, font color=4294967295) -> (rule properties out=w15)
  call "Create Style.gvi"(rule selector=w12, rule properties=w15) -> (style reference=w16, error out=w17)
  Build Array(w4, w9, w16) -> w18
  Merge Errors(w5, w10, w17) -> (error out=w19)
  sequence {
    frame 0 {
      # Set data grid values after creating styles to prevent Flash of Unstyled Content (FOUC)
      w20 = [{"Highlight pass and fail exact"="pass", "Highlight fail contains"="fail"}, {"Highlight pass and fail exact"="Pass", "Highlight fail contains"="Fail"}, {"Highlight pass and fail exact"="PaSs", "Highlight fail contains"="Failure"}, {"Highlight pass and fail exact"="fail", "Highlight fail contains"="It failed"}, {"Highlight pass and fail exact"="Fail", "Highlight fail contains"="fial"}, {"Highlight pass and fail exact"="failure", "Highlight fail contains"=""}, {"Highlight pass and fail exact"="other", "Highlight fail contains"=""}]
      $"Highlight text" <- w20
    }
  }
  s1 = w19  # shift register
  while {
    Logical Or(s1, $stop) -> w21
    stop if w21
  }
  for {
    w22 = each element of w18
    call "Remove Style.gvi"(style reference=w22, error in=s1) -> (error out=w23)
    call "Show Error Dialog.gvi"(error in=w23)
  }
