vi "index.gviweb"   [G Web Development Software 22.3.0]
panel controls:
  "name": string
  "message": string
  "send": bool
panel indicators:
  "messages": cluster{"name": string, "message": string}[]
types:
  "message.gtype" = cluster{"name": string, "message": string}
uses:
  NI::HTTP::POST Buffer.gvi
  NI::HTTP::GET.gvi
diagram:
  while {
    event {
      on "send" Value changed {
        Property Node(instance in="message.gtype" {all zero or empty}, "name"=$name, "message"=$message) -> (instance out=w1)
        Flatten To Json(anything=w1) -> (JSON string=w2, error out=w3)
        call "POST Buffer.gvi"(url="/message", buffer=w2, error in=w3)
      }
    }
    stop if FALSE
  }
  while {
    call "GET.gvi"(url="/message") -> (body=w4)
    Unflatten From Json(JSON string=w4, type and defaults=string[] []) -> (value=w5)
    for {
      w6 = each element of w5
      Unflatten From Json(JSON string=w6, type and defaults="message.gtype" {all zero or empty}) -> (value=w8)
      append w8 to w7
    }
    $messages <- w7
    Wait(time to wait=500)
    stop if FALSE
  }
