vi "main.gviweb"   [G Web Development Software 22.3.0]
uses:
  DenoHTTP::Simple URL Pattern.gvi
  DenoHTTP::HTTP Create Listeners.gvi
  Deno::Current Working Directory Get.gvi
  URL::URL::URL Build Relative Path.gvi
  DenoHTTP::HTTP Serve Files.gvi
  SimpleServer::Support::Simple Log Error.gvi
diagram:
  call "Simple URL Pattern.gvi"() -> (url pattern=w1)
  Build Array(w1) -> w2
  call "HTTP Create Listeners.gvi"(url patterns=w2) -> (http listener references=w3, error out=w4)
  Array Index(array=w3) -> (out0[_]=w5)
  # Expect to run from root of Deno project.
  # So paths relative to that location.
  call "Current Working Directory Get.gvi"() -> (current working directory url=w6)
  call "URL Build Relative Path.gvi"(base url (window location)=w6, relative url="./Builds/SimpleClient_Default Web Server/") -> (url=w7)
  call "HTTP Serve Files.gvi"(http listener reference=w5, root path url=w7, error in=w4) -> (error out=w8)
  call "Simple Log Error.gvi"(error In=w8)
