vi "KV List String.gvi"   [G Web Development Software 22.3.0]
inputs:
  "error in": error
  "kv reference in": "kv reference.gtype", required
  "key": string[], required
  "limit": u32
  "reverse": bool
outputs:
  "error out": error
  "kv reference out": "kv reference.gtype"
  "values": string[]
types:
  "kv reference.gtype" = "NI.JavaScriptReference"
uses:
  DenoKV::Support::DenoKV.jsli::KvListString
diagram:
  $"kv reference out" <- $"kv reference in"
  Flatten To Json(anything=$key, error in (no error)=$"error in") -> (JSON string=w1, error out=w2)
  call "KvListString"(kvReference=$"kv reference in", keyPrefixJSON=w1, limit=$limit, reverse=$reverse, error in=w2) -> (valueJSON=w3, error out=w4)
  Unflatten From Json(JSON string=w3, error in (no error)=w4, type and defaults=string[] []) -> (error out=w5, value=w6)
  $values <- w6
  $"error out" <- w5
