vi "Update Tag.gvi"   [G Web Development Software 22.3.0]
inputs:
  "error in": error
  "value": string, required
  "api key": string, required
outputs:
  "error out": error
uses:
  NI::Skyline::Configuration::Open Configuration API Key.gvi
  NI::Skyline::TagHTTP::Open Tag.gvi
  NI::Skyline::TagHTTP::Write Tag (String).gvi
  NI::Skyline::Configuration::Close Configuration.gvi
diagram:
  call "Open Configuration API Key.gvi"(server url="https://api.systemlinkcloud.com", api key=$"api key", error in=$"error in") -> (configuration=w1, error out=w2)
  call "Open Tag.gvi"(path="deno-deploy-string", data type="String", error in=w2, configuration=w1) -> (tag=w3, error out=w4)
  call "Write Tag (String).gvi"(tag in=w3, value=$value, error in=w4) -> (error out=w5)
  call "Close Configuration.gvi"(configuration=w1, error in=w5) -> (error out=w6)
  $"error out" <- w6
