vi "Create EChart.gvi"   [LabVIEW NXG 3.1.0]
inputs:
  "selector": string, required
  "error in": error
outputs:
  "error out": error
  "echart refnum": "echart refnum.gtype"
types:
  "echart refnum.gtype" = i32
uses:
  ECharts::Support::ECharts.jsli::CreateEChart
  ECharts::Shared Options::Set Animation Options.gvi
  ECharts::Shared Options::Set Color Options.gvi
  ECharts::Shared Options::Set Text Style Options.gvi
  ECharts::Core::Update EChart Options.gvi
diagram:
  call "CreateEChart"(selector=$selector, error in=$"error in") -> (echart refnum=w1, error out=w2)
  w3 = [4286191129, 4278882018, 4292982147, 4290161445, 4289584110, 4288645807, 4286479998, 4282058533]
  call "Set Animation Options.gvi"(animation?=FALSE) -> (echart options out=w4)
  call "Set Color Options.gvi"(echart options in=w4, color=w3) -> (echart options out=w5)
  # Create the echart and set defaults. This will disable animations by default, use an NXG color palette, and NXG default fonts.
  call "Set Text Style Options.gvi"(echart options in=w5, color=4281020467, font family="Segoe UI", font size=9) -> (echart options out=w6)
  call "Update EChart Options.gvi"(echart refnum in=w1, echart options=w6, error in=w2) -> (echart refnum out=w7, error out=w8)
  $"echart refnum" <- w7
  $"error out" <- w8
