vi "Destroy EChart.gvi"   [LabVIEW NXG 3.1.0]
inputs:
  "echart reference": "echart reference.gtype", required
  "error in": error
outputs:
  "error out": error
types:
  "echart reference.gtype" = i32
uses:
  ECharts::Support::ECharts.jsli::DestroyEChart
diagram:
  call "DestroyEChart"(echart reference=$"echart reference") -> (error out=w1)
  Merge Errors($"error in", w1) -> (error out=w2)
  $"error out" <- w2
