vi "Update EChart Options.gvi"   [LabVIEW NXG 3.1.0]
inputs:
  "echart refnum in": "echart refnum.gtype", required
  "echart options": "echart options.gtype", required
  "error in": error
outputs:
  "error out": error
  "echart refnum out": "echart refnum.gtype"
types:
  "echart refnum.gtype" = i32
  "option.gtype" = cluster{"name": string, "propertiesJSON": string}
  "echart options.gtype" = "option.gtype"[]
uses:
  ECharts::Support::ECharts.jsli::UpdateEChart
diagram:
  $"echart refnum out" <- $"echart refnum in"
  Flatten To JSON(anything=$"echart options") -> (JSON string=w1)
  call "UpdateEChart"(echart refnum=$"echart refnum in", options array json=w1, error in=$"error in") -> (error out=w2)
  $"error out" <- w2
