vi "Set Axis 3D.gvi"   [LabVIEW NXG 3.1.0]
inputs:
  "echart options in": "echart options.gtype"
  "axis 3d": "axis 3d.gtype" = "x", required
  "type": "axis 3d type.gtype" = "value"
outputs:
  "echart options out": "echart options.gtype"
types:
  "option.gtype" = cluster{"name": string, "propertiesJSON": string}
  "echart options.gtype" = "option.gtype"[]
  "axis 3d.gtype" = enum{"x", "y", "z"}
  "axis 3d type.gtype" = enum{"value", "category", "time", "log"}
uses:
  ECharts::Support::Append Option.gvi
diagram:
  Format Into String(formatString="%sAxis3D", $"axis 3d") -> w1
  Format Into String($type) -> w2
  Property Node(instance in=cluster{"type": string} {all zero or empty}, "type"=w2) -> (instance out=w3)
  Flatten To JSON(anything=w3) -> (JSON string=w4)
  # https://ecomfe.github.io/echarts-doc/public/cn/option-gl.html#zAxis3D
  call "Append Option.gvi"(echart options in=$"echart options in", name=w1, propertiesJSON=w4) -> (echart options out=w5)
  # https://ecomfe.github.io/echarts-doc/public/cn/option-gl.html#xAxis3D
  # https://ecomfe.github.io/echarts-doc/public/cn/option-gl.html#yAxis3D
  $"echart options out" <- w5
