vi "Set Animation Options.gvi"   [LabVIEW NXG 3.1.0]
inputs:
  "echart options in": "echart options.gtype"
  "animation?": bool
outputs:
  "echart options out": "echart options.gtype"
types:
  "option.gtype" = cluster{"name": string, "propertiesJSON": string}
  "echart options.gtype" = "option.gtype"[]
uses:
  ECharts::Support::Append Option.gvi
diagram:
  Select(s=$"animation?", t="true", f="false") -> w1
  call "Append Option.gvi"(echart options in=$"echart options in", name="animation", propertiesJSON=w1) -> (echart options out=w2)
  # https://ecomfe.github.io/echarts-doc/public/en/option.html#animation
  $"echart options out" <- w2
