vi "Set Color Options.gvi"   [LabVIEW NXG 3.1.0]
inputs:
  "echart options in": "echart options.gtype"
  "color": "Color.gtype"[]
outputs:
  "echart options out": "echart options.gtype"
types:
  "option.gtype" = cluster{"name": string, "propertiesJSON": string}
  "echart options.gtype" = "option.gtype"[]
  "Color.gtype" = u32
uses:
  ECharts::Support::Color to CSS rgba.gvi
  ECharts::Support::Append Option.gvi
diagram:
  for {
    w1 = each element of $color
    call "Color to CSS rgba.gvi"(Input=w1) -> (Output=w3)
    append w3 to w2
  }
  Flatten To JSON(anything=w2) -> (JSON string=w4)
  # https://ecomfe.github.io/echarts-doc/public/en/option.html#color
  call "Append Option.gvi"(echart options in=$"echart options in", name="color", propertiesJSON=w4) -> (echart options out=w5)
  $"echart options out" <- w5
