vi "Append Surface Series Options.gvi"   [LabVIEW NXG 3.1.0]
inputs:
  "echart options in": "echart options.gtype"
  "data": cluster{"value": f64[]}[], required
outputs:
  "echart options out": "echart options.gtype"
types:
  "option.gtype" = cluster{"name": string, "propertiesJSON": string}
  "echart options.gtype" = "option.gtype"[]
  T1 = cluster{"type": string, "data": cluster{"value": f64[]}[]}
uses:
  ECharts::Support::Append Option.gvi
diagram:
  Property Node(instance in=T1 {"type"="surface", "data"=[]}, "data"=$data) -> (instance out=w1)
  # https://ecomfe.github.io/echarts-doc/public/cn/option-gl.html#series-surface
  Flatten To JSON(anything=w1) -> (JSON string=w2)
  call "Append Option.gvi"(echart options in=$"echart options in", name="series", propertiesJSON=w2) -> (echart options out=w3)
  $"echart options out" <- w3
