vi "Generate Pie Data.gvi"   [G Web Development Software 22.3.0]
outputs:
  "pie data": cluster{"name": string, "value": f64}[]
diagram:
  w1 = ["arya stark", "sansa stark", "jon snow", "tyrion lanister", "jamie lanister", "daeneris tarygarion", "jora", "hodor"]
  for {
    w2 = each element of w1
    Random Number() -> (number (0 to 1)=w4)
    Property Node(instance in=cluster{"name": string, "value": f64} {all zero or empty}, "name"=w2, "value"=w4) -> (instance out=w5)
    append w5 to w3
  }
  $"pie data" <- w3
