vi "index.gviweb"   [LabVIEW NXG 3.1.0]
panel indicators:
  "URL Image": string
  "URL Image_2": string
  "gauge": string
uses:
  ECharts::Core::Create EChart.gvi
  ECharts::Shared Options 3D::Set Grid 3D.gvi
  ECharts::Shared Options 3D::Set Axis 3D.gvi
  ECharts::Core::Update EChart Options.gvi
  ECharts::Gauge Options::Append Gauge Series Options.gvi
  WebApp::Generate Pie Data.gvi
  ECharts::Pie Options::Append Pie Series Options.gvi
  WebApp::Generate Surface Data.gvi
  ECharts::Surface Options::Append Surface Series Options.gvi
  ECharts::Core::Destroy EChart.gvi
diagram:
  call "Create EChart.gvi"(selector=".my-pie-chart") -> (echart reference=w1, error out=w2)
  call "Create EChart.gvi"(selector=".my-scatter-chart") -> (echart reference=w3, error out=w4)
  call "Set Grid 3D.gvi"() -> (echart options out=w5)
  call "Set Axis 3D.gvi"(echart options in=w5, axis 3d="x") -> (echart options out=w6)
  call "Set Axis 3D.gvi"(echart options in=w6, axis 3d="y") -> (echart options out=w7)
  call "Set Axis 3D.gvi"(echart options in=w7, axis 3d="z") -> (echart options out=w8)
  call "Update EChart Options.gvi"(echart reference in=w3, error in=w4, echart options=w8) -> (echart reference out=w9, error out=w10)
  call "Create EChart.gvi"(selector=".my-gauge") -> (echart reference=w11, error out=w12)
  s1 = w2  # shift register
  s2 = w10  # shift register
  s3 = w12  # shift register
  while (iteration -> i1) {
    Wait(time to wait=10)
    call "Append Gauge Series Options.gvi"(data=i1) -> (echart options out=w13)
    call "Update EChart Options.gvi"(echart reference in=w11, error in=s3, echart options=w13) -> (echart reference out=w14, error out=w15)
    call "Generate Pie Data.gvi"() -> (pie data=w16)
    call "Append Pie Series Options.gvi"(data=w16) -> (echart options out=w17)
    call "Update EChart Options.gvi"(echart reference in=w1, error in=s1, echart options=w17) -> (echart reference out=w18, error out=w19)
    call "Generate Surface Data.gvi"() -> (Output=w20)
    call "Append Surface Series Options.gvi"(data=w20) -> (echart options out=w21)
    call "Update EChart Options.gvi"(echart reference in=w9, error in=s2, echart options=w21) -> (echart reference out=w22, error out=w23)
    Merge Errors(w15, w19, w23) -> (error out=w24)
    next s1 = w19
    next s2 = w23
    next s3 = w15
    stop if w24
  }
  call "Destroy EChart.gvi"(echart reference=w14, error in=s3)
  call "Destroy EChart.gvi"(echart reference=w18, error in=s1)
  call "Destroy EChart.gvi"(echart reference=w22, error in=s2)
