vi "Add Keyboard Event Listener.gvi"   [LabVIEW NXG 5.0.0]
inputs:
  "error in": error
  "prevent default": bool
  "keyboard event type": "keyboard event type.gtype" = "keydown", required
outputs:
  "event manager reference": "event manager reference.gtype"
  "error out": error
types:
  "keyboard event type.gtype" = enum{"keydown", "keyup"}
  "event manager reference.gtype" = "NI.JavaScriptReference"
uses:
  EventTarget::Support::EventTarget.jsli::GetTarget
  EventTarget::Support::EventTarget.jsli::AddKeyboardEventListener
diagram:
  call "GetTarget"(type="window", error in=$"error in") -> (target=w1, error out=w2)
  Format Into String(errIn=w2, $"keyboard event type") -> (outString=w3, errOut=w4)
  call "AddKeyboardEventListener"(target=w1, eventName=w3, preventDefault=$"prevent default", error in=w4) -> (eventStreamReader=w5, error out=w6)
  Close Reference(error in=w6, reference=w1) -> (error out=w7)
  $"error out" <- w7
  $"event manager reference" <- w5
