vi "Listen For Keyboard Events.gvi"   [LabVIEW NXG 5.0.0]
inputs:
  "error in": error
  "event manager reference in": "event manager reference.gtype", required
outputs:
  "error out": error
  "event manager reference out": "event manager reference.gtype"
  "code": string
  "key": string
types:
  "event manager reference.gtype" = "NI.JavaScriptReference"
uses:
  EventTarget::Support::EventTarget.jsli::WaitForKeyboardEvent
diagram:
  call "WaitForKeyboardEvent"(eventStreamReader=$"event manager reference in", error in=$"error in") -> (eventDataJSON=w1, error out=w2)
  Unflatten From Json(JSON string=w1, error in (no error)=w2, type and defaults=cluster{"code": string, "key": string} {all zero or empty}) -> (error out=w3, value=w4)
  Property Node(instance in=w4) -> ("code"=w5, "key"=w6)
  $code <- w5
  $"event manager reference out" <- $"event manager reference in"
  $key <- w6
  $"error out" <- w3
