vi "index.gviweb"   [LabVIEW NXG 5.0.0]
panel controls:
  "Keyboard event on specific elements": string
panel indicators:
  "code": string
  "key": string
  "element code": string
  "element key": string
  "immediate string control value": string
uses:
  EventTarget::Get Target::Get Target - Document.gvi
  EventTarget::Keyboard::Add Keyboard Event Listener.gvi
  EventTarget::Keyboard::Listen For Keyboard Events.gvi
  EventTarget::Get Target::Get Target - Selector.gvi
  StringControlHelpers::Get Immediate Value.gvi
diagram:
  call "Get Target - Document.gvi"() -> (document=w1, error out=w2)
  call "Add Keyboard Event Listener.gvi"(target in=w1, keyboard event type="keydown", error in=w2) -> (keyboard user event=w3, error out=w4, event listener configuration out=w5)
  call "Listen For Keyboard Events.gvi"(event listener configuration=w5)
  call "Get Target - Selector.gvi"(selector=".my-element") -> (element=w6, error out=w7)
  call "Add Keyboard Event Listener.gvi"(target in=w6, keyboard event type="keydown", error in=w7) -> (keyboard user event=w8, error out=w9, event listener configuration out=w10)
  Merge Errors(w4, w9) -> (error out=w11)
  Register For Events("keyboard event"=w3, "keyboard event"=w8, error in=w11) -> (error out=w12, event registration refnum out=w13)
  s1 = w12  # shift register
  while {
    event (timeout = 100) (dynamic events = w13) {
      on "Timeout" {
        w14 = s1
      }
      on dynamic event 0 {
        call "Get Immediate Value.gvi"(selector=".my-element") -> (value=w15)
        $"immediate string control value" <- w15
        Event Data() -> ("code"=w16, "key"=w17)
        $code <- w16
        $key <- w17
        w14 = s1
      }
      on dynamic event 1 {
        Event Data() -> ("code"=w18, "key"=w19)
        $"element code" <- w18
        $"element key" <- w19
        w14 = s1
      }
    }
    next s1 = w14
    stop if w14
  }
  Property Node(instance in=s1) -> ("source"=w20)
  One Button Dialog(message=w20)
  call "Listen For Keyboard Events.gvi"(event listener configuration=w10)
