vi "Calculate.gvi"   [LabVIEW NXG 5.0.0]
inputs:
  "error in": error
  "expressionStr": string
outputs:
  "error out": error
uses:
  Exorbitant::Support::Exorbitant.jsli::CreateExorbitant
  Exorbitant::Support::Exorbitant.jsli::CreateExpression
  Exorbitant::Support::Exorbitant.jsli::CreateParser
  Exorbitant::Support::Exorbitant.jsli::CreateSymbolTable
  Exorbitant::Support::Exorbitant.jsli::ExpressionRegisterSymbolTable
  Exorbitant::Support::Exorbitant.jsli::ParserCompile
  Exorbitant::Support::Exorbitant.jsli::ExpressionValue
diagram:
  call "CreateExorbitant"(error in=$"error in") -> (exorbitant=w1, error out=w2)
  call "CreateExpression"(exorbitant=w1, error in=w2) -> (expression=w3, error out=w4)
  call "CreateParser"(exorbitant=w1, error in=w2) -> (parser=w5, error out=w6)
  call "CreateSymbolTable"(exorbitant=w1, error in=w2) -> (symbolTable=w7, error out=w8)
  Merge Errors(w8, w4) -> (error out=w9)
  call "ExpressionRegisterSymbolTable"(expression=w3, symbolTable=w7, error in=w9) -> (error out=w10)
  Merge Errors(w10, w6) -> (error out=w11)
  call "ParserCompile"(parser=w5, expressionStr=$expressionStr, expression=w3, error in=w11) -> (error out=w12)
  call "ExpressionValue"(expression=w3, error in=w12) -> (error out=w13)
  $"error out" <- w13
