vi "POST Multipart Ext.gvi"   [G Web Development Software 21.0.0]
inputs:
  "request configuration": "Request Configuration.gtype"
  "timeout": i32 = 10000  # timeout specifies the amount of time in milliseconds to wait for a response from the server before the Web request times out. The default value is 10000 ms. A value of -1 defers timeout monitoring to the operating system.
  "error in": error
  "data": "Multipart Data Array Ext.gtype"
  "url": string, required  # URL specifies the URL of the server, Web page, or Web service which this VI sends the Web request.
  "output file": path  # output file specifies a file to save body data returned by the server. If you do not specify an output file, the VI does not save the body data to a file.
outputs:
  "headers": string  # headers returns the header fields returned by the server. Refer to the World Wide Web Consortium website at www.w3.org for more information about header field definitions including available headers, descriptions, and syntax.
  "body": string  # body returns body data returned by the server.
  "error out": error
  "status code": u32
types:
  "Headers.gtype" = string
  T1 = cluster{"header": "Headers.gtype", "value": string}
  "Request Configuration.gtype" = cluster{"includeCredentials": bool, "headers": T1[]}
  "Multipart Data Ext.gtype" = cluster{"Name": string, "Value": string, "File": "NI.JavaScriptReference", "Filename": string, "MIME type": string}
  "Multipart Data Array Ext.gtype" = "Multipart Data Ext.gtype"[]
  T2 = cluster{"headers": string, "body": string, "status": u32}
uses:
  HTTPExtensions::Support::Validate Empty Path.gvi
  HTTPExtensions::Support::Format Post Data.gvi
  HTTPExtensions::Support::HTTPExtensions.jsli::PostMultipartExt
diagram:
  call "Validate Empty Path.gvi"(path=$"output file", error in=$"error in") -> (error out=w1)
  Flatten To Json(anything=$"request configuration", error in (no error)=w1) -> (JSON string=w2, error out=w3)
  call "Format Post Data.gvi"(data=$data, error in=w3) -> (post data json=w4, post data files=w5, error out=w6)
  call "PostMultipartExt"(requestConfigurationJSON=w2, url=$url, timeout=$timeout, postDataJSON=w4, postDataFiles=w5, error in=w6) -> (return=w7, error out=w8)
  Unflatten From Json(JSON string=w7, error in (no error)=w8, type and defaults=T2 {all zero or empty}) -> (error out=w9, value=w10)
  Property Node(instance in=w10) -> ("headers"=w11, "body"=w12, "status"=w13)
  $headers <- w11
  $body <- w12
  $"status code" <- w13
  $"error out" <- w9
