vi "index.gviweb"   [G Web Development Software 22.0.0]
panel controls:
  "capture image": bool
  "load text": bool
  "text": string
  "save text": bool
  "text file name": string
  "load binary": bool
  "binary file name": string
  "save binary": bool
  "download graph snapshot": bool
  "Tab": i32
  "download tab snapshot": bool
panel indicators:
  "image blob url": string
  "number of bytes": i32
  "number of bytes (base64 encoded)": i32
  "image data uri": string
  "Graph": f64[]
uses:
  File::File Url::Close File Url.gvi
  WebApp::Support::Show Error Dialog.gvi
  FileTasks::Capture Image as File.gvi
  File::File Url::Create File Url.gvi
  File::Read File.gvi
  File::Close File.gvi
  Base64::Create Data Url.gvi
  FileTasks::Read File Text.gvi
  FileTasks::Download File Text.gvi
  FileTasks::Read File Binary.gvi
  Base64::Base64 Encode.gvi
  Base64::Base64 Decode.gvi
  FileTasks::Download File Binary.gvi
  Snapshot::Get Image.gvi
  File::Download File.gvi
diagram:
  for (N = 100) {
    Random Number() -> (number (0 to 1)=w2)
    append w2 to w1
  }
  $Graph <- w1
  s1 = ""  # shift register
  s2 = ""  # shift register
  while {
    event {
      on "capture image" Value changed {
        case (s1) {
          frame Default {
            # cleanup previous snapshot
            call "Close File Url.gvi"(url=s1) -> (error out=w5)
            call "Show Error Dialog.gvi"(error in=w5)
          }
          frame "" { }
        }
        Build Array("image/jpeg") -> w6
        call "Capture Image as File.gvi"(allowed file types=w6) -> (file reference=w7, error out=w8)
        call "Create File Url.gvi"(file reference in=w7, error in=w8) -> (file reference out=w9, file object url=w3, error out=w10)
        $"image blob url" <- w3
        call "Read File.gvi"(file reference in=w9, error in=w10) -> (file reference out=w11, file contents=w12, error out=w13)
        call "Close File.gvi"(file reference=w11, error in=w13) -> (error out=w14)
        call "Show Error Dialog.gvi"(error in=w14)
        call "Create Data Url.gvi"(data=w12, content type="image/jpeg", error in=w13) -> (data url=w15, error out=w16)
        $"image data uri" <- w15
        call "Show Error Dialog.gvi"(error in=w16)
        w4 = s2
      }
      on "load text" Value changed {
        call "Read File Text.gvi"(allowed file types=[".txt"]) -> (file content=w17, file name=w18, error out=w19)
        $text <- w17
        $"text file name" <- w18
        call "Show Error Dialog.gvi"(error in=w19)
        w3 = s1
        w4 = s2
      }
      on "save text" Value changed {
        call "Download File Text.gvi"(file contents=$text, file name=$"text file name") -> (error out=w20)
        call "Show Error Dialog.gvi"(error in=w20)
        w3 = s1
        w4 = s2
      }
      on "load binary" Value changed {
        call "Read File Binary.gvi"() -> (file contents=w21, file name=w22, error out=w23)
        Array Size(array=w21) -> (size(s)=w24)
        $"number of bytes" <- w24
        call "Base64 Encode.gvi"(data=w21, error in=w23) -> (encoded data=w4, error out=w25)
        String Length(string=w4) -> (length=w26)
        $"number of bytes (base64 encoded)" <- w26
        call "Show Error Dialog.gvi"(error in=w25)
        $"binary file name" <- w22
        w3 = s1
      }
      on "save binary" Value changed {
        call "Base64 Decode.gvi"(encoded data=s2) -> (data=w27, error out=w28)
        call "Download File Binary.gvi"(file contents=w27, file name=$"binary file name", error in=w28) -> (error out=w29)
        call "Show Error Dialog.gvi"(error in=w29)
        w3 = s1
        w4 = s2
      }
      on "download graph snapshot" Value changed {
        call "Get Image.gvi"(selector=".my-graph") -> (file reference=w30, error out=w31)
        call "Download File.gvi"(file reference in=w30, error in=w31) -> (file reference out=w32, error out=w33)
        call "Close File.gvi"(file reference=w32, error in=w33) -> (error out=w34)
        call "Show Error Dialog.gvi"(error in=w34)
        # Note that the selector string ".my-graph" matches the HTML Class Attribute "my-graph" but has a period prefix
        w3 = s1
        w4 = s2
      }
      on "download tab snapshot" Value changed {
        # Note that the selector string ".my-tab" matches the HTML Class Attribute "my-tab" but has a period prefix
        call "Get Image.gvi"(selector=".my-tab") -> (file reference=w35, error out=w36)
        call "Download File.gvi"(file reference in=w35, error in=w36) -> (file reference out=w37, error out=w38)
        call "Close File.gvi"(file reference=w37, error in=w38) -> (error out=w39)
        call "Show Error Dialog.gvi"(error in=w39)
        w3 = s1
        w4 = s2
      }
    }
    next s1 = w3
    next s2 = w4
    stop if FALSE
  }
