vi "index.gviweb"   [G Web Development Software 21.0.0]
panel indicators:
  "headers": string
  "body": string
  "status code": u32
types:
  "Multipart Data Ext.gtype" = cluster{"Name": string, "Value": string, "File": "NI.JavaScriptReference", "Filename": string, "MIME type": string}
  "Multipart Data Array Ext.gtype" = "Multipart Data Ext.gtype"[]
uses:
  FileTasks::Capture Image as File.gvi
  HTTPExtensions::POST Multipart Ext.gvi
  WebApp::Support::Show Error Dialog.gvi
diagram:
  call "Capture Image as File.gvi"() -> (file reference=w1, error out=w2)
  Property Node(instance in="Multipart Data Ext.gtype" {all zero or empty}, "File"=w1) -> (instance out=w3)
  Build Array("Multipart Data Array Ext.gtype" [], w3) -> w4
  call "POST Multipart Ext.gvi"(url="https://httpbin.org/post", data=w4, error in=w2) -> (status code=w5, headers=w6, body=w7, error out=w8)
  $headers <- w6
  $body <- w7
  call "Show Error Dialog.gvi"(error in=w8)
  $"status code" <- w5
