vi "systemlink.gviweb"   [G Web Development Software 22.0.0]
panel controls:
  "query": bool
  "delete": bool
  "clear": bool
  "query filters": i32
  "timestamp": timestamp
  "name": string
  "name operator": T2 = "contains"
  "extension operator": enum{"equal", "not equal"} = "equal"
  "extension": string
  "property operator": T2 = "contains"
  "key": string
  "value": string
  "size operator": T3 = "greater than or equal"
  "size (bytes)": i32
  "created operator": T4 = "greater than or equal"
panel indicators:
  "Files": T1[]
  "last updated": timestamp
types:
  T1 = cluster{"name": string, "created": string, "size": string, "id": string}
  T2 = enum{"contains", "not contains", "equal", "not equal"}
  T3 = enum{"equal", "not equal", "less than", "greater than", "less than or equal", "greater than or equal"}
  T4 = enum{"less than", "greater than", "less than or equal", "greater than or equal"}
uses:
  NI::Skyline::Configuration::Open Configuration.gvi
  NI::Skyline::File::Create Filter (Name).gvi
  NI::Skyline::File::Create Filter (Extension).gvi
  NI::Skyline::File::Create Filter (Property).gvi
  NI::Skyline::File::Create Filter (Size in bytes).gvi
  NI::Skyline::File::Create Filter (Created Time Stamp).gvi
  NI::Skyline::File::Query Files.gvi
  NI::Skyline::File::Get File Metadata.gvi
  WebApp::Support::Show Error Dialog.gvi
  WebApp::Support::Clear Selection.gvi
  WebApp::Support::Selection Buttons Disabled.gvi
  NI::Skyline::File::Open File.gvi
  SystemLinkFileExtensions::Delete File Ex (Single).gvi
  NI::Skyline::File::Merge Metadata Properties.gvi
  NI::Skyline::File::Get Property.gvi
diagram:
  call "Open Configuration.gvi"(username="admin", password="test") -> (configuration=w1)
  while {
    event {
      on "query" Value changed {
        Get Current Time() -> (current time=w2)
        $"last updated" <- w2
        case ($"query filters") {
          frame 0, Default {
            w3 = default
          }
          frame 1 {
            call "Create Filter (Name).gvi"(name=$name, operator=$"name operator") -> (filter out=w3)
          }
          frame 2 {
            call "Create Filter (Extension).gvi"(extension=$extension, operator=$"extension operator") -> (filter out=w3)
          }
          frame 3 {
            call "Create Filter (Property).gvi"(key=$key, value=$value, operator=$"property operator") -> (filter out=w3)
          }
          frame 4 {
            call "Create Filter (Size in bytes).gvi"(size=$"size (bytes)", operator=$"size operator") -> (filter out=w3)
          }
          frame 5 {
            call "Create Filter (Created Time Stamp).gvi"(time stamp=$timestamp, operator=$"created operator") -> (filter out=w3)
          }
        }
        call "Query Files.gvi"(filter in=w3, configuration=w1) -> (files=w4, error out=w5)
        for {
          w6 = each element of w4
          call "Get File Metadata.gvi"(file in=w6) -> (id=w8, metadata=w9)
          Property Node(instance in=w9) -> ("name"=w10, "created"=w11, "size"=w12)
          Format Date Time String(time stamp=w11) -> (date/time string=w13)
          Format Into String(w12) -> w14
          Property Node(instance in=T1 {all zero or empty}, "id"=w8, "name"=w10, "created"=w13, "size"=w14) -> (instance out=w15)
          append w15 to w7
        }
        $Files <- w7
        call "Show Error Dialog.gvi"(error in=w5)
        Property Node(instance in=reference to "query", "Value"=FALSE) -> (error out=w16)
        call "Clear Selection.gvi"(error in=w16) -> (error out=w17)
        call "Show Error Dialog.gvi"(error in=w17)
      }
      on "Files" Selection changed {
        Event Data() -> ("SelectedData:id"=w18)
        Is Empty String Or Path(string/path=w18) -> w19
        call "Selection Buttons Disabled.gvi"(disabled=w19) -> (error out=w20)
        call "Show Error Dialog.gvi"(error in=w20)
      }
      on "delete" Value changed {
        Property Node(instance in=reference to "Files") -> ("SelectedData"=w21)
        Property Node(instance in=w21) -> ("id"=w22)
        case (w22) {
          frame Default {
            call "Open File.gvi"(file id=w22, configuration=w1) -> (file=w23, error out=w24)
            call "Delete File Ex (Single).gvi"(file=w23, error in=w24) -> (error out=w25)
            Property Node(instance in=reference to "query", "ValueSignaling"=TRUE, error in=w25) -> (error out=w26)
            call "Show Error Dialog.gvi"(error in=w26)
          }
          frame "" { }
        }
      }
      on "clear" Value changed {
        call "Clear Selection.gvi"() -> (error out=w27)
        call "Show Error Dialog.gvi"(error in=w27)
      }
    }
    stop if FALSE
  }
  Property Node(instance in=reference to "query", "Value"=FALSE) -> (error out=w28)
  Property Node(instance in=reference to "Files", "ColumnHeaders"=["name", "created", "size (bytes)", "id"], error in=w28) -> (error out=w29, instance out=w30)
  Build Array(reference to "delete", reference to "clear") -> w31
  call "Clear Selection.gvi"(control references=w31, tree=w30, error in=w29) -> (error out=w32)
  call "Show Error Dialog.gvi"(error in=w32)
  disable {
    frame Enabled { }
    frame Disabled {
      call "Merge Metadata Properties.gvi"()
      # https://www.ni.com/docs/en-US/bundle/systemlink-2020-r3-2021-r1-labview-nxg-api-ref/page/file-transfer-nodes.html
      call "Get Property.gvi"()
    }
  }
