vi "Get File Metadata.gvi"   [LabVIEW NXG 5.0.0]
inputs:
  "file reference in": "NI.JavaScriptReference", required
  "error in": error
outputs:
  "file reference out": "NI.JavaScriptReference"
  "error out": error
  "file name": string
uses:
  FileApi::Support::FileApi.jsli::GetFileMetadata
diagram:
  call "GetFileMetadata"(fileReference=$"file reference in", error in=$"error in") -> (fileMetadataJSON=w1, error out=w2)
  Unflatten From Json(JSON string=w1, error in (no error)=w2, type and defaults=cluster{"name": string} {all zero or empty}) -> (error out=w3, value=w4)
  Property Node(instance in=w4) -> ("name"=w5)
  $"file name" <- w5
  $"file reference out" <- $"file reference in"
  $"error out" <- w3
