vi "Capture Image as File.gvi"   [LabVIEW NXG 3.1.0]
inputs:
  "allowed file types": string[]
  "error in": error
  "countdown": bool
  "mirror": bool
  "facing mode": "facing modes.gtype" = "user"
outputs:
  "error out": error
  "file reference": "file reference.gtype"
types:
  "file reference.gtype" = string
  "facing modes.gtype" = enum{"user", "environment", "left", "right"}
uses:
  Uppy::Set Uppy Core Options.gvi
  Uppy::Set Uppy Dashboard Options.gvi
  Uppy::Set Uppy Webcam Options.gvi
  Uppy::Request Files.gvi
diagram:
  call "Set Uppy Core Options.gvi"(max number of files=1, allowed file types=$"allowed file types") -> (uppy options out=w1)
  call "Set Uppy Dashboard Options.gvi"(uppy options in=w1, show uppy icon?=FALSE) -> (uppy options out=w2)
  call "Set Uppy Webcam Options.gvi"(uppy options in=w2, countdown=$countdown, mirror=$mirror, facing mode=$"facing mode") -> (uppy options out=w3)
  call "Request Files.gvi"(uppy options=w3, error in=$"error in") -> (file references=w4, error out=w5)
  Array Index(array=w4) -> (out0[_]=w6)
  $"file reference" <- w6
  $"error out" <- w5
