vi "Download File Binary.gvi"   [LabVIEW NXG 3.1.0]
inputs:
  "file contents": u8[], required
  "file name": string, required
  "content type": string
  "error in": error
outputs:
  "error out": error
uses:
  FileApi::Create File.gvi
  FileApi::Download File.gvi
  FileApi::Close File.gvi
diagram:
  call "Create File.gvi"(file contents=$"file contents", content type=$"content type", error in=$"error in") -> (uppy file reference=w1, error out=w2)
  call "Download File.gvi"(uppy file reference in=w1, file name=$"file name", error in=w2) -> (uppy file reference out=w3, error out=w4)
  call "Close File.gvi"(uppy file reference=w3, error in=w4) -> (error out=w5)
  $"error out" <- w5
