vi "Read File Binary.gvi"   [LabVIEW NXG 3.1.0]
inputs:
  "allowed file types": string[]
  "error in": error
outputs:
  "error out": error
  "file contents": u8[]
uses:
  Uppy::Set Uppy Core Options.gvi
  Uppy::Set Uppy Dashboard Options.gvi
  Uppy::Request Files.gvi
  FileApi::Read File.gvi
  FileApi::Close File.gvi
diagram:
  call "Set Uppy Core Options.gvi"(max number of files=1, allowed file types=$"allowed file types") -> (uppy options out=w1)
  call "Set Uppy Dashboard Options.gvi"(uppy options in=w1, show uppy icon?=FALSE) -> (uppy options out=w2)
  call "Request Files.gvi"(uppy options=w2, error in=$"error in") -> (file references=w3, error out=w4)
  Array Index(array=w3) -> (out0[_]=w5)
  call "Read File.gvi"(file reference in=w5, error in=w4) -> (file contents=w6, error out=w7)
  for {
    w8 = each element of w3
    call "Close File.gvi"(file reference=w8, error in=w7) -> (error out=w9)
  }
  $"error out" <- w9
  $"file contents" <- w6
