vi "Request Files.gvi"   [LabVIEW NXG 5.0.0]
inputs:
  "error in": error
  "uppy options": "uppy options.gtype"
outputs:
  "file references": "NI.JavaScriptReference"[]
  "error out": error
types:
  "option.gtype" = cluster{"propertiesJSON": string}
  "uppy options.gtype" = "option.gtype"[]
uses:
  Uppy::Support::Uppy.jsli::RequestFiles
diagram:
  Flatten To Json(anything=$"uppy options") -> (JSON string=w1)
  call "RequestFiles"(optionsArrayJSON=w1, error in=$"error in") -> (files=w2, error out=w3)
  $"file references" <- w2
  $"error out" <- w3
