vi "Set Uppy Webcam Options.gvi"   [LabVIEW NXG 3.1.0]
inputs:
  "uppy options in": "uppy options.gtype"
  "countdown": bool
  "mirror": bool
outputs:
  "uppy options out": "uppy options.gtype"
types:
  "option.gtype" = cluster{"propertiesJSON": string}
  "uppy options.gtype" = "option.gtype"[]
  T1 = cluster{"countdown": bool, "mirror": bool, "modes": string[]}
uses:
  Uppy::Support::Append Option.gvi
diagram:
  # Find more options at https://uppy.io/docs/webcam/
  w1 = cluster{"webcam": T1} {"webcam"={"countdown"=FALSE, "mirror"=TRUE, "modes"=["picture"]}}
  Property Node(instance in=w1, "webcam:countdown"=$countdown, "webcam:mirror"=$mirror) -> (instance out=w2)
  Flatten To JSON(anything=w2) -> (JSON string=w3)
  call "Append Option.gvi"(uppy options in=$"uppy options in", propertiesJSON=w3) -> (uppy options out=w4)
  $"uppy options out" <- w4
