vi "CaptureImageToUpload.gviweb"   [LabVIEW NXG 3.1.0]
panel indicators:
  "URL Image": string
uses:
  FileTasks::Capture Image as File.gvi
  FileApi::Get File Object Url.gvi
diagram:
  call "Capture Image as File.gvi"() -> (file reference=w1, error out=w2)
  call "Get File Object Url.gvi"(file reference in=w1, error in=w2) -> (file object url=w3)
  $"URL Image" <- w3
