vi "index.gviweb"   [LabVIEW NXG 5.0.0]
panel controls:
  "stop": bool
types:
  "attribute.gtype" = cluster{"name": string, "value": string}
uses:
  IFrame::Create IFrame.gvi
  IFrame::Remove IFrame.gvi
diagram:
  Property Node(instance in="attribute.gtype" {all zero or empty}, "name"="src", "value"="https://www.youtube.com/embed/2R5x5bzp3uk") -> (instance out=w1)
  w2 = "accelerometer; autoplay; clipboard-write; encrypted-media; gyroscope; picture-in-picture"
  Property Node(instance in="attribute.gtype" {all zero or empty}, "name"="allow", "value"=w2) -> (instance out=w3)
  Property Node(instance in="attribute.gtype" {all zero or empty}, "name"="allowfullscreen", "value"="") -> (instance out=w4)
  Property Node(instance in="attribute.gtype" {all zero or empty}, "name"="style", "value"="border: none;") -> (instance out=w5)
  Build Array(w1, w3, w4, w5) -> w6
  call "Create IFrame.gvi"(placeholder reference=reference to "YouTube Video", attributes=w6) -> (iframe reference=w7, error out=w8)
  while {
    Wait(time to wait=50)
    stop if $stop
  }
  call "Remove IFrame.gvi"(iframe reference=w7, error in=w8)
