vi "Create and Append AR Scene.gvi"   [LabVIEW NXG 5.0.0]
inputs:
  "selector": string, required
  "error in": error
  "ar panel url": string, required
  "parent document target reference (global document)": "dom reference.gtype"
  "clear parent content": bool = TRUE
outputs:
  "error out": error
  "ar document target reference": "dom reference.gtype"
  "scene reference": "dom reference.gtype"
types:
  "dom reference.gtype" = "NI.JavaScriptReference"
uses:
  DOM::Tasks::Replace Element Content with IFrame.gvi
  DOM::Values::Append Attribute.gvi
  AFrame::Scene::Create and Append Scene.gvi
  AFrame::Entity::Create and Append Entity.gvi
diagram:
  call "Replace Element Content with IFrame.gvi"(selector=$selector, url=$"ar panel url", error in=$"error in", parent document target reference (global document)=$"parent document target reference (global document)") -> (iframe=w1, iframe document=w2, error out=w3)
  $"ar document target reference" <- w2
  w4 = "debugUIEnabled: false; cameraParametersUrl: AR/Support/node_modules/ar_js/data/data/camera_para.dat"
  call "Append Attribute.gvi"(name="arjs", value=w4) -> (dom values out=w5)
  Close Reference(error in=w3, reference=w1) -> (error out=w6)
  call "Create and Append Scene.gvi"(clear parent content=$"clear parent content", selector="body", dom values=w5, error in=w6, document target reference (global document)=w2) -> (scene reference=w7, error out=w8)
  call "Append Attribute.gvi"(name="camera") -> (dom values out=w9)
  call "Create and Append Entity.gvi"(parent reference in=w7, dom values=w9, error in=w8, document target reference (global document)=w2) -> (parent reference out=w10, error out=w11)
  $"scene reference" <- w10
  $"error out" <- w11
