vi "Create Entity.gvi"   [LabVIEW NXG 4.0.0]
inputs:
  "error in": error
  "entity attributes": "entity attributes.gtype"
  "scene reference in": "scene reference.gtype"
outputs:
  "entity reference": "entity reference.gtype"
  "error out": error
  "scene reference out": "scene reference.gtype"
types:
  "dom value type.gtype" = enum{"unknown", "attribute", "absent", "undefined", "boolean", "number", "string"}
  "dom value.gtype" = cluster{"type": "dom value type.gtype", "name": string, "value": string}
  "dom values.gtype" = "dom value.gtype"[]
  "entity attributes.gtype" = cluster{"dom values": "dom values.gtype"}
  "scene reference.gtype" = i32
  "entity reference.gtype" = u32
uses:
  DOM::Build::Create Elements.gvi
  AugmentedReality::Entity::Update Entity.gvi
  DOM::Tasks::Select Element and Append Content.gvi
diagram:
  $"scene reference out" <- $"scene reference in"
  call "Create Elements.gvi"(tag names=["a-entity"], error in=$"error in", document target reference (global document)=$"scene reference in", inert?=FALSE) -> (element references=w1, error out=w2)
  Array Index(array=w1) -> (out0[_]=w3)
  call "Update Entity.gvi"(entity reference in=w3, entity attributes=$"entity attributes", error in=w2) -> (entity reference out=w4, error out=w5)
  call "Select Element and Append Content.gvi"(parent selector="a-marker", child dom reference in=w4, error in=w5, parent document target reference (global document)=$"scene reference in") -> (child dom reference out=w6, error out=w7)
  $"entity reference" <- w6
  $"error out" <- w7
