vi "Create GLTF Model Entity.gvi"   [LabVIEW NXG 4.0.0]
inputs:
  "scene reference in": "scene reference.gtype", required
  "error in": error
  "src": string, required
  "entity attributes": "entity attributes.gtype"
outputs:
  "scene reference out": "scene reference.gtype"
  "entity reference": "entity reference.gtype"
  "error out": error
types:
  "entity reference.gtype" = u32
  "dom value type.gtype" = enum{"unknown", "attribute", "absent", "undefined", "boolean", "number", "string"}
  "dom value.gtype" = cluster{"type": "dom value type.gtype", "name": string, "value": string}
  "dom values.gtype" = "dom value.gtype"[]
  "entity attributes.gtype" = cluster{"dom values": "dom values.gtype"}
  "scene reference.gtype" = i32
uses:
  DOM::Values::Append Attribute.gvi
  DOM::Build::Create Elements.gvi
  DOM::Monitor::Add Event Listener.gvi
  AugmentedReality::Entity::Update Entity.gvi
  DOM::Tasks::Select Element and Append Content.gvi
  DOM::Monitor::Wait For Event.gvi
  DOM::Monitor::Remove Event Listener.gvi
diagram:
  $"scene reference out" <- $"scene reference in"
  Property Node(instance in=$"entity attributes") -> ("dom values"=w1, instance out=w2)
  call "Append Attribute.gvi"(dom values in=w1, name="src", value=$src) -> (dom values out=w3)
  Property Node(instance in=w2, "dom values"=w3) -> (instance out=w4)
  Build Array("a-gltf-model") -> w5
  call "Create Elements.gvi"(tag names=w5, error in=$"error in", document target reference (global document)=$"scene reference in", inert?=FALSE) -> (element references=w6, error out=w7)
  # TODO add check for model-error
  Array Index(array=w6) -> (out0[_]=w8)
  call "Add Event Listener.gvi"(element reference in=w8, event name="model-loaded", error in=w7) -> (element reference out=w9, event manager reference=w10, error out=w11)
  call "Update Entity.gvi"(entity reference in=w9, entity attributes=w4, error in=w11) -> (entity reference out=w12, error out=w13)
  call "Select Element and Append Content.gvi"(parent selector="a-marker", child dom reference in=w12, error in=w13, parent document target reference (global document)=$"scene reference in") -> (child dom reference out=w14, error out=w15)
  $"entity reference" <- w14
  call "Wait For Event.gvi"(event manager reference in=w10, error in=w15) -> (event manager reference out=w16, error out=w17)
  call "Remove Event Listener.gvi"(event manager reference=w16, error in=w17) -> (error out=w18)
  $"error out" <- w18
