vi "index.gviweb"   [LabVIEW NXG 4.0.0]
panel controls:
  "Decrypt Data": bool
  "Hyperlink Control": string = "https://sketchfab.com/3d-models/wooden-box-8c2d0108d70b4dc0a4f4bc58a31ed765"
panel indicators:
  "Output": error
uses:
  AugmentedReality::Scene::Create Scene.gvi
  AugmentedReality::Entity::Create GLTF Model Entity.gvi
  AugmentedReality::Entity Attributes::Text.gvi
  AugmentedReality::Entity Attributes::Position.gvi
  AugmentedReality::Entity Attributes::Rotation.gvi
  AugmentedReality::Entity::Create Entity.gvi
  AugmentedReality::Entity Attributes::Animation Mixer.gvi
  AugmentedReality::Entity::Update Entity.gvi
diagram:
  call "Create Scene.gvi"(selector=".vrdemo") -> (scene reference=w1, error out=w2)
  call "Create GLTF Model Entity.gvi"(scene reference in=w1, src="../../wooden_box/scene.gltf", error in=w2) -> (scene reference out=w3, entity reference=w4, error out=w5)
  call "Text.gvi"(text="1243") -> (entity attributes out=w6)
  call "Position.gvi"(entity attributes in=w6, x=-0.75, y=0.2, z=0) -> (entity attributes out=w7)
  call "Rotation.gvi"(entity attributes in=w7, x=-90, y=0, z=0) -> (entity attributes out=w8)
  call "Create Entity.gvi"(scene reference in=w3, entity attributes=w8, error in=w5) -> (error out=w9)
  s1 = w9  # shift register
  while {
    event (timeout = 100) {
      on "Decrypt Data" Value changed {
        call "Animation Mixer.gvi"() -> (entity attributes out=w11)
        call "Update Entity.gvi"(entity reference in=w4, entity attributes=w11, error in=s1) -> (error out=w10)
      }
      on "Timeout" {
        w10 = s1
      }
    }
    next s1 = w10
    stop if w10
  }
  $Output <- s1
