vi "index.gviweb"   [LabVIEW NXG 4.0.0]
panel controls:
  "index": i32
  "online": bool
  "offline": bool
panel indicators:
  "URL Image": string
uses:
  AFrame::Support::Include AFrame Dependencies.gvi
  DOM::Build::Create Document Fragment.gvi
  DOM::Search::Query Selector All.gvi
  DOM::Values::Append Attribute.gvi
  AFrame::Scene::Create and Append Scene.gvi
  DOM::Build::Append Children.gvi
  AFrame::Entity Attributes::Text.gvi
  DOM::Configure::Create Style Attribute Value.gvi
  DOM::Configure::Set Attributes and Properties.gvi
diagram:
  call "Include AFrame Dependencies.gvi"()
  w1 = """<a-gltf-model src="sts.glb" animation="property: rotation; to: 0 360 0; loop: true; dur: 10000; easing:easeInOutQuad" position="-2.5 0 -4"><a-entity text-geometry="value:offline" position="-1 1.5 0" material="color:red"></a-entity></a-gltf-model>
<a-gltf-model src="sts.glb" animation="property: rotation; to: 0 360 0; loop: true; dur: 10000; easing:easeInOutQuad"  position="0 0 -4"><a-entity text-geometry="value:offline" position="-1 1.5 0" material="color:red"></a-entity></a-gltf-model>
<a-gltf-model src="sts.glb" animation="property: rotation; to: 0 360 0; loop: true; dur: 10000; easing:easeInOutQuad"  position="2.5 0 -4"><a-entity text-geometry="value:offline" position="-1 1.5 0" material="color:red"></a-entity></a-gltf-model>"""
  call "Create Document Fragment.gvi"(content=w1, inert?=FALSE) -> (document fragment reference=w2)
  call "Query Selector All.gvi"(dom target reference in (global document)=w2, selector="a-entity[text-geometry]") -> (element references=w3, error out=w4)
  call "Append Attribute.gvi"(name="renderer", value="colorManagement: true") -> (dom values out=w5)
  call "Create and Append Scene.gvi"(selector=".my-scene", dom values=w5) -> (scene reference=w6)
  Build Array(w2) -> w7
  call "Append Children.gvi"(parent reference in=w6, child references=w7, error in=w4) -> (error out=w8)
  while (after w8) {
    event {
      on "online" Value changed {
        Array Index(array=w3) -> (out0[$index]=w9)
        call "Text.gvi"(text="online") -> (dom values out=w10)
        call "Create Style Attribute Value.gvi"(style property names=["color"], style property values=["green"]) -> (style attribute value=w11)
        call "Append Attribute.gvi"(dom values in=w10, name="material", value=w11) -> (dom values out=w12)
        call "Set Attributes and Properties.gvi"(element reference in=w9, dom values=w12)
      }
      on "offline" Value changed {
        Array Index(array=w3) -> (out0[$index]=w13)
        call "Text.gvi"(text="offline") -> (dom values out=w14)
        call "Create Style Attribute Value.gvi"(style property names=["color"], style property values=["red"]) -> (style attribute value=w15)
        call "Append Attribute.gvi"(dom values in=w14, name="material", value=w15) -> (dom values out=w16)
        call "Set Attributes and Properties.gvi"(element reference in=w13, dom values=w16)
      }
    }
    stop if FALSE
  }
