vi "index.gviweb"   [LabVIEW NXG 4.0.0]
panel controls:
  "Height Offset of Box": u32
  "start camera": bool
  "Tab": i32
  "Hyperlink Control": string = "https://sketchfab.com/models/031875966a5740f18ac4cffa8b14031d#"
  "Hyperlink Control_2": string = "https://medium.com/arjs/augmented-reality-in-10-lines-of-html-4e193ea9fdbf"
  "clear model": bool
panel indicators:
  "URL Image": string
  "Output": error
uses:
  AR::Create and Append AR Scene.gvi
  AR::Create and Append AR Marker.gvi
  AFrame::Entity::Create and Append GLTF Model Entity.gvi
  AFrame::Entity Attributes::Position.gvi
  DOM::Configure::Set Attributes and Properties.gvi
diagram:
  sequence {
    frame 0 {
      $"URL Image" <- "AR/Support/node_modules/ar_js/data/images/hiro.png"
    }
  }
  while {
    Wait(time to wait=10)
    stop if $"start camera"
  }
  call "Create and Append AR Scene.gvi"(clear parent content=FALSE, selector=".eagle-demo", ar panel url="AugmentedRealityPanel.html", error in=no error) -> (scene reference=w1, error out=w2, ar document target reference=w3)
  call "Create and Append AR Marker.gvi"(parent reference in=w1, error in=w2, document target reference (global document)=w3) -> (entity reference=w4)
  call "Create and Append GLTF Model Entity.gvi"(parent reference in=w4, src="scene.gltf", document target reference (global document)=w3) -> (entity reference=w5, error out=w6)
  s1 = w6  # shift register
  while {
    Wait(time to wait=10)
    call "Position.gvi"(x=0, y=$"Height Offset of Box", z=0) -> (dom values out=w7)
    call "Set Attributes and Properties.gvi"(element reference in=w5, dom values=w7, error in=s1) -> (error out=w8)
    Logical Or(w8, $"clear model") -> w9
    next s1 = w8
    stop if w9
  }
  $Output <- s1
