vi "Add Event Listener.gvi"   [LabVIEW NXG 5.0.0]
inputs:
  "error in": error
  "input element in": "input element.gtype", required
outputs:
  "event configuration": "event listener configuration.gtype"
  "error out": error
  "change user event": "event change"
  "input element out": "input element.gtype"
types:
  "input element.gtype" = "NI.JavaScriptReference"
  "event stream reader.gtype" = "NI.JavaScriptReference"
  "event listener configuration.gtype" = cluster{"event stream reader": "event stream reader.gtype", "change user event": "event change", "error in": error}
uses:
  InputElement::Support::InputElement.jsli::AddEventListener
diagram:
  $"input element out" <- $"input element in"
  call "AddEventListener"(inputElement=$"input element in", name="change", error in=$"error in") -> (eventStreamReader=w1, error out=w2)
  Create User Event[EventName=change](error in=w2, user event data type=string "") -> (error out=w3, user event out=w4)  # Create User Event: change
  Property Node(instance in="event listener configuration.gtype" {all zero or empty}, "event stream reader"=w1, "change user event"=w4, "error in"=w3) -> (instance out=w5)
  $"event configuration" <- w5
  $"change user event" <- w4
  $"error out" <- w3
