vi "Remove Event Listener.gvi"   [LabVIEW NXG 5.0.0]
inputs:
  "error in": error
  "event stream reader": "event stream reader.gtype", required
outputs:
  "error out": error
types:
  "event stream reader.gtype" = "NI.JavaScriptReference"
uses:
  InputElement::Support::InputElement.jsli::RemoveEventListener
diagram:
  call "RemoveEventListener"(eventStreamReader=$"event stream reader") -> (error out=w1)
  Close Reference(error in=w1, reference=$"event stream reader") -> (error out=w2)
  Merge Errors($"error in", w2) -> (error out=w3)
  $"error out" <- w3
