vi "index.gviweb"   [LabVIEW NXG 5.0.0]
panel controls:
  "password value": string
  "date value": string
  "color value": string
  "password get": bool
  "password set": bool
  "date get": bool
  "date set": bool
  "color get": bool
  "color set": bool
panel indicators:
  "password change event": string
  "date change event": string
  "color change event": string
uses:
  InputElement::Create Input Element.gvi
  InputElement::Value Event::Add Event Listener.gvi
  InputElement::Value Event::Listen for Events.gvi
  InputElement::Value::Get Value.gvi
  InputElement::Value::Set Value.gvi
diagram:
  call "Create Input Element.gvi"(placeholder=reference to "password", attributes=[{"name"="type", "value"="password"}]) -> (input element=w1, error out=w2)
  call "Add Event Listener.gvi"(input element in=w1, error in=w2) -> (change user event=w3, input element out=w4, error out=w5, event configuration out (duplicate)=w6, error out (duplicate)=w7)
  call "Listen for Events.gvi"(event configuration=w6, error in=w7)
  Register For Events("change"=w3, error in=w5) -> (error out=w8, event registration refnum out=w9)
  s1 = w8  # shift register
  while {
    event (dynamic events = w9) {
      on dynamic event 0 {
        Event Data() -> ("event data"=w11)
        $"password change event" <- w11
        w10 = s1
      }
      on "password get" Value changed {
        call "Get Value.gvi"(input element in=w4, error in=s1) -> (value=w12, error out=w10)
        $"password value" <- w12
      }
      on "password set" Value changed {
        call "Set Value.gvi"(input element in=w4, value=$"password value", error in=s1) -> (error out=w10)
      }
    }
    next s1 = w10
    stop if w10
  }
  Property Node(instance in=s1) -> ("source"=w13)
  One Button Dialog(message=w13)
  call "Create Input Element.gvi"(placeholder=reference to "date", attributes=[{"name"="type", "value"="date"}]) -> (input element=w14, error out=w15)
  call "Add Event Listener.gvi"(input element in=w14, error in=w15) -> (change user event=w16, input element out=w17, error out=w18, event configuration out (duplicate)=w19, error out (duplicate)=w20)
  call "Listen for Events.gvi"(event configuration=w19, error in=w20)
  Register For Events("change"=w16, error in=w18) -> (error out=w21, event registration refnum out=w22)
  s2 = w21  # shift register
  while {
    event (dynamic events = w22) {
      on dynamic event 0 {
        Event Data() -> ("event data"=w24)
        $"date change event" <- w24
        w23 = s2
      }
      on "date get" Value changed {
        call "Get Value.gvi"(input element in=w17, error in=s2) -> (value=w25, error out=w23)
        $"date value" <- w25
      }
      on "date set" Value changed {
        call "Set Value.gvi"(input element in=w17, value=$"date value", error in=s2) -> (error out=w23)
      }
    }
    next s2 = w23
    stop if w23
  }
  Property Node(instance in=s2) -> ("source"=w26)
  One Button Dialog(message=w26)
  call "Create Input Element.gvi"(placeholder=reference to "color", attributes=[{"name"="type", "value"="color"}]) -> (input element=w27, error out=w28)
  call "Add Event Listener.gvi"(input element in=w27, error in=w28) -> (change user event=w29, input element out=w30, error out=w31, event configuration out (duplicate)=w32, error out (duplicate)=w33)
  call "Listen for Events.gvi"(event configuration=w32, error in=w33)
  Register For Events("change"=w29, error in=w31) -> (error out=w34, event registration refnum out=w35)
  s3 = w34  # shift register
  while {
    event (dynamic events = w35) {
      on dynamic event 0 {
        Event Data() -> ("event data"=w37)
        $"color change event" <- w37
        w36 = s3
      }
      on "color get" Value changed {
        call "Get Value.gvi"(input element in=w30, error in=s3) -> (value=w38, error out=w36)
        $"color value" <- w38
      }
      on "color set" Value changed {
        call "Set Value.gvi"(input element in=w30, value=$"color value", error in=s3) -> (error out=w36)
      }
    }
    next s3 = w36
    stop if w36
  }
  Property Node(instance in=s3) -> ("source"=w39)
  One Button Dialog(message=w39)
