vi "Encode JSON.gvi"   [LabVIEW NXG 3.1.0]
inputs:
  "json tokens": "JSON Tokens.gtype"
outputs:
  "json string": string
types:
  "Type.gtype" = enum{"Array", "ArrayEnd", "ArrayDouble", "ArrayString", "ArrayBoolean", "Object", "ObjectKey", "ObjectEnd", "Double", "String", "True", "False", "Null"}
  "Token.gtype" = cluster{"type": "Type.gtype", "data": string, "offsets": i32[]}
  "JSON Tokens.gtype" = "Token.gtype"[]
uses:
  JSONParser::Support::Encode JSON Coersion Helper.gvi
  JSONParser::Support::JSONParser.jsli::JSONStringify
  JSONParser::Support::Concatenate Separator.gvi
diagram:
  disable {
    frame Enabled {
      call "Encode JSON Coersion Helper.gvi"(JSON Tokens Raw in=$"json tokens") -> (JSON Tokens Raw out=w2)
      # Optimized version doing encoding in JS. Adds overhead for small objects but has a better general case for mid-size to large objects.
      disable {
        frame Disabled {
          Flatten To JSON(anything=w2) -> (JSON string=w3)
        }
        frame Enabled {
          # Workaround, crashes the runtime when ~20K JSON Tokens are passed to Flatten To JSON. Unwound the outer array with this for loop to avoid the crash. CAR filed.
          for (N -> w4) (iteration -> i1) {
            w5 = each element of w2
            Flatten To JSON(anything=w5) -> (JSON string=w7)
            Decrement(x=w4) -> w8
            Is Equal(x=w8, y=i1) -> w9
            Select(s=w9, t="", f=",") -> w10
            Concatenate Strings(w7, w10) -> w11
            append w11 to w6
          }
          Concatenate Strings("[", w6, "]") -> w3
        }
      }
      call "JSONStringify"(tokensJSON=w3) -> (jsonString=w1)
    }
    frame Disabled {
      w12 = 0  # level
      # Having primarily homogeneous optimized arrays or small objects is fast in G. Heterogeneous arrays or large data sets not consisting of homogeneous optimized arrays are much slower. The optimize case calling to JS may be a better tradeoff. Maybe should use a heuristic to decide which to call?
      s1 = ""  # shift register
      s2 = w12  # shift register
      for (iteration -> i2) {
        w13 = each element of $"json tokens"
        Increment(x=i2) -> w14
        Array Index(array=$"json tokens") -> (out0[w14]=w15)
        Property Node(instance in=w15) -> ("type"=w16)
        Property Node(instance in=w13) -> ("type"=w17, "data"=w18)
        case (w17) {
          frame "Array" {
            Concatenate Strings(s1, "[") -> w19
            Increment(x=s2) -> w20
          }
          frame "ArrayEnd" {
            Concatenate Strings(s1, "]") -> w21
            Decrement(x=s2) -> w20
            call "Concatenate Separator.gvi"(partial json string in=w21, next token type=w16, level=w20) -> (partial json string out=w19)
          }
          frame "ArrayDouble", "ArrayString", "ArrayBoolean" {
            Concatenate Strings(s1, w18) -> w22
            call "Concatenate Separator.gvi"(partial json string in=w22, next token type=w16, level=s2) -> (partial json string out=w19)
            w20 = s2
          }
          frame "Object" {
            Concatenate Strings(s1, "{") -> w19
            Increment(x=s2) -> w20
          }
          frame "ObjectKey" {
            Build Array(w18) -> w23
            # TODO: write a proper json string escape instead
            Flatten To JSON(anything=w23) -> (JSON string=w24)
            String Length(string=w24) -> (length=w25)
            Subtract(x=w25, y=2) -> w26
            String Subset(length (rest)=w26, offset (0)=1, string=w24) -> w27
            Concatenate Strings(s1, w27, ":") -> w19
            w20 = s2
          }
          frame "ObjectEnd" {
            Concatenate Strings(s1, "}") -> w28
            Decrement(x=s2) -> w20
            call "Concatenate Separator.gvi"(partial json string in=w28, next token type=w16, level=w20) -> (partial json string out=w19)
          }
          frame "Double" {
            Concatenate Strings(s1, w18) -> w29
            call "Concatenate Separator.gvi"(partial json string in=w29, next token type=w16, level=s2) -> (partial json string out=w19)
            w20 = s2
          }
          frame "String" {
            Build Array(w18) -> w30
            # TODO: write a proper json string escape instead
            Flatten To JSON(anything=w30) -> (JSON string=w31)
            String Length(string=w31) -> (length=w32)
            Subtract(x=w32, y=2) -> w33
            String Subset(length (rest)=w33, offset (0)=1, string=w31) -> w34
            Concatenate Strings(s1, w34) -> w35
            call "Concatenate Separator.gvi"(partial json string in=w35, next token type=w16, level=s2) -> (partial json string out=w19)
            w20 = s2
          }
          frame "True" {
            Concatenate Strings(s1, "true") -> w36
            call "Concatenate Separator.gvi"(partial json string in=w36, next token type=w16, level=s2) -> (partial json string out=w19)
            w20 = s2
          }
          frame "False" {
            Concatenate Strings(s1, "false") -> w37
            call "Concatenate Separator.gvi"(partial json string in=w37, next token type=w16, level=s2) -> (partial json string out=w19)
            w20 = s2
          }
          frame "Null" {
            Concatenate Strings(s1, "") -> w38
            call "Concatenate Separator.gvi"(partial json string in=w38, next token type=w16, level=s2) -> (partial json string out=w19)
            w20 = s2
          }
        }
        next s1 = w19
        next s2 = w20
      }
      w1 = s1
    }
  }
  $"json string" <- w1
