vi "Parse JSON.gvi"   [LabVIEW NXG 3.1.0]
inputs:
  "json string": string, required
  "error in": error
outputs:
  "json tokens": "JSON Tokens.gtype"
  "error out": error
types:
  "JSON Token Type.gtype" = enum{"Array", "ArrayEnd", "ArrayDouble", "ArrayString", "ArrayBoolean", "Object", "ObjectKey", "ObjectEnd", "Double", "String", "True", "False", "Null"}
  "JSON Token.gtype" = cluster{"json token type": "JSON Token Type.gtype", "data": string, "offsets": i32[]}
  "JSON Tokens.gtype" = "JSON Token.gtype"[]
  "Parse JSON Token.gtype" = cluster{"T": u16, "D": string, "O": i32[]}
  "Parse JSON Tokens.gtype" = "Parse JSON Token.gtype"[]
uses:
  JSONParser::Support::JSONParser.jsli::JSONTokenize
  JSONParser::Support::Parse JSON Tokens to JSON Tokens.gvi
diagram:
  call "JSONTokenize"(jsonString=$"json string", error in=$"error in") -> (tokensJSON=w1, error out=w2)
  Unflatten From JSON(JSON string=w1, error in (no error)=w2, type and defaults="Parse JSON Tokens.gtype" []) -> (error out=w3, value=w4)
  call "Parse JSON Tokens to JSON Tokens.gvi"(Parse JSON Tokens=w4) -> (JSON Tokens=w5)
  $"json tokens" <- w5
  $"error out" <- w3
