vi "index.gviweb"   [LabVIEW NXG 3.1.0]
panel controls:
  "json in": string[] = ["[]"]
panel indicators:
  "json out": string[]
uses:
  JSONParser::Parse JSON.gvi
  JSONParser::Encode JSON.gvi
diagram:
  for {
    w1 = each element of $"json in"
    call "Parse JSON.gvi"(json string=w1) -> (json tokens=w3)
    call "Encode JSON.gvi"(json tokens=w3) -> (json string=w4)
    append w4 to w2
  }
  $"json out" <- w2
