vi "stress.gviweb"   [LabVIEW NXG 3.1.0]
panel controls:
  "optimize array contents": bool = TRUE
  "start": bool
  "array size": i32 = 100000
  "generate faster": bool = TRUE
  "render reencoded string": bool
panel indicators:
  "generation time": u32
  "parse time": u32
  "encode time": u32
  "reencoded string": string
  "status": string
uses:
  WebApp::Support::stress generate.gvi
  JSONParser::Parse JSON.gvi
  JSONParser::Encode JSON.gvi
diagram:
  sequence {
    frame 0 {
      while {
        Wait(time to wait=10)
        stop if $start
      }
      $status <- "not running press start"
    }
    frame 1 {
      $status <- "starting data generation"
      Tick Count() -> (timer value=w1)
    }
    frame 2 {
      call "stress generate.gvi"(array size=$"array size", generate faster (size only multiple of 10000)=$"generate faster", optimize array contents=$"optimize array contents") -> (generated json=w2)
    }
    frame 3 {
      $status <- "starting data parse"
      Tick Count() -> (timer value=w3)
      Subtract(x=w3, y=w1) -> w4
      $"generation time" <- w4
    }
    frame 4 {
      call "Parse JSON.gvi"(json string=w2) -> (json tree=w5)
    }
    frame 5 {
      $status <- "starting data encode"
      Tick Count() -> (timer value=w6)
      Subtract(x=w6, y=w3) -> w7
      $"parse time" <- w7
    }
    frame 6 {
      call "Encode JSON.gvi"(json tree=w5) -> (json string=w8)
    }
    frame 7 {
      $status <- "updating reencoded string"
      Tick Count() -> (timer value=w9)
      Subtract(x=w9, y=w6) -> w10
      $"encode time" <- w10
    }
    frame 8 {
      # try and let other controls have a chance to update before writing that huge string
      Wait(time to wait=500)
    }
    frame 9 {
      Select(s=$"render reencoded string", t=w8, f="skipped render") -> w11
      $"reencoded string" <- w11
      $status <- "done"
    }
  }
