vi "Load MobileNet.gvi"   [LabVIEW NXG 3.1.0]
inputs:
  "error in": error
outputs:
  "error out": error
  "model reference": "model reference.gtype"
types:
  "model reference.gtype" = i32
uses:
  TensorFlow::Load TensorFlow.gvi
  MobileNet::Support::MobileNet.jsli::LoadMobileNet
diagram:
  call "Load TensorFlow.gvi"(error in=$"error in") -> (error out=w1)
  call "LoadMobileNet"(error in=w1) -> (modelReference=w2, error out=w3)
  $"model reference" <- w2
  $"error out" <- w3
