vi "Create Map.gvi"   [LabVIEW NXG 5.0.0]
inputs:
  "placeholder reference": "HtmlContainer reference", required
  "latitude (austin, tx)": f64 = 30.2672
  "longitude (austin, tx)": f64 = -97.7431
  "zoom level (from 0-18)": i32 = 13
  "error in": error
outputs:
  "error out": error
  "map reference": "map reference.gtype"
types:
  "map reference.gtype" = "NI.JavaScriptReference"
uses:
  GoogleMap::Support::GoogleMap.jsli::CreateMap
diagram:
  Obtain JavaScript Reference(reference in=$"placeholder reference", error in=$"error in") -> (error out=w1, javascript reference out=w2)
  call "CreateMap"(placeholder=w2, lat=$"latitude (austin, tx)", lng=$"longitude (austin, tx)", zoom=$"zoom level (from 0-18)", error in=w1) -> (map=w3, error out=w4)
  $"map reference" <- w3
  $"error out" <- w4
