vi "Create Marker.gvi"   [LabVIEW NXG 5.1.0]
inputs:
  "error in": error
  "coordinate": "coordinate.gtype", required
  "title": string
  "icon url (default icon)": string  # The icon image url relative to the running top-level VI
outputs:
  "error out": error
  "marker reference": "marker reference.gtype"
types:
  "marker reference.gtype" = "NI.JavaScriptReference"
  "coordinate.gtype" = cluster{"latitude": f64, "longitude": f64}
uses:
  GoogleMap::Support::GoogleMap.jsli::CreateMarker
diagram:
  Property Node(instance in=$coordinate) -> ("latitude"=w1, "longitude"=w2)
  call "CreateMarker"(lat=w1, lng=w2, title=$title, iconUrl=$"icon url (default icon)", error in=$"error in") -> (marker=w3, error out=w4)
  $"marker reference" <- w3
  $"error out" <- w4
