vi "Destroy Marker.gvi"   [LabVIEW NXG 5.0.0]
inputs:
  "error in": error
  "marker reference": "marker reference.gtype", required
outputs:
  "error out": error
types:
  "marker reference.gtype" = "NI.JavaScriptReference"
uses:
  GoogleMap::Support::GoogleMap.jsli::DestroyMarker
diagram:
  call "DestroyMarker"(marker=$"marker reference") -> (error out=w1)
  Merge Errors($"error in", w1) -> (error out=w2)
  $"error out" <- w2
