vi "Create Map.gvi"   [LabVIEW NXG 5.0.0]
# Create a Leaflet map using the Open Street Maps tileset.
# To use this VI drop a text decoration on your front panel (not a string control) and position it where desired.
# Select the text control and in the HTML Class Attribute field of the right-rail add a class name to uniquely identify the text control. For example the string “my-map” without the quotes.
# Pass the class attribute used to the selector input using CSS Selector syntax. For example, the HTML Class Attribute “my-map” would have the CSS selector syntax “.my-map” without the quotes.
inputs:
  "placeholder reference": "HtmlContainer reference", required
  "latitude (austin, tx)": f64 = 30.2672
  "longitude (austin, tx)": f64 = -97.7431
  "error in": error
  "zoom level (from 0-18)": i32 = 13
outputs:
  "error out": error
  "map reference": "map reference.gtype"
types:
  "map reference.gtype" = "NI.JavaScriptReference"
uses:
  Leaflet::Support::Leaflet.jsli::MapCreate
diagram:
  Obtain JavaScript Reference(reference in=$"placeholder reference", error in=$"error in") -> (error out=w1, javascript reference out=w2)
  call "MapCreate"(placeholder=w2, latitude=$"latitude (austin, tx)", longitude=$"longitude (austin, tx)", zoom level=$"zoom level (from 0-18)", error in=w1) -> (map=w3, error out=w4)
  $"map reference" <- w3
  $"error out" <- w4
