vi "Destroy Map.gvi"   [LabVIEW NXG 5.0.0]
# Destroys a map reference and removes the map and markers from the panel.
# You must close marker references individually to free them from memory; destroying the associated map does not clear the markers from memory.
inputs:
  "map reference": "map reference.gtype", required
  "error in": error
outputs:
  "error out": error
types:
  "map reference.gtype" = "NI.JavaScriptReference"
uses:
  Leaflet::Support::Leaflet.jsli::DestroyMap
diagram:
  call "DestroyMap"(map=$"map reference") -> (error out=w1)
  Merge Errors($"error in", w1) -> (error out=w2)
  $"error out" <- w2
