vi "Create Marker.gvi"   [LabVIEW NXG 5.1.0]
# Adds a marker to the specified latitude and longitude. The text is associated with a popup for the marker that is visible when clicked or when Show Marker Popup is called.
inputs:
  "coordinate": "coordinate.gtype", required
  "error in": error
  "icon url (default icon)": string  # The icon image url relative to the running top-level VI
  "text": string
outputs:
  "marker reference": "marker reference.gtype"
  "error out": error
types:
  "marker reference.gtype" = "NI.JavaScriptReference"
  "coordinate.gtype" = cluster{"latitude": f64, "longitude": f64}
uses:
  Leaflet::Support::Leaflet.jsli::CreateMarker
diagram:
  Property Node(instance in=$coordinate) -> ("latitude"=w1, "longitude"=w2)
  call "CreateMarker"(latitude=w1, longitude=w2, text=$text, iconUrl=$"icon url (default icon)", error in=$"error in") -> (marker=w3, error out=w4)
  $"marker reference" <- w3
  $"error out" <- w4
