vi "Table Create.gvi"   [G Web Development Software 22.0.0]
inputs:
  "schema": variant, required
  "error in": error
outputs:
  "table reference": "table reference.gtype"
  "error out": error
panel indicators:
  "schemaprobe": variant
types:
  "table reference.gtype" = "NI.JavaScriptReference"
uses:
  Perspective::Support::Perspective.jsli::TableCreate
diagram:
  # Requirements:
  # - schemaprobe must not be wired to connector pane and name must be unchanged
  # - VI must be named "Table Create.gvi" and be in the "Perspective::Table" namespace
  # - VI must be non reentrant
  sequence {
    frame 0 {
      Set Variant Attribute(name="data", value=$schema, variant=variant()) -> (variant out=w1)
    }
    frame 1 {
      $schemaprobe <- w1
    }
    frame 2 {
      call "TableCreate"(error in=$"error in") -> (table=w2, error out=w3)
      $"table reference" <- w2
      $"error out" <- w3
    }
  }
