vi "index.gviweb"   [G Web Development Software 22.0.0]
panel controls:
  "interval (ms)": f64 = 10
types:
  "data.gtype" = cluster{"x": f64, "y": f64}
uses:
  Perspective::Viewer::Viewer Create.gvi
  Perspective::Table::Table Create.gvi
  Perspective::Viewer::Viewer Load.gvi
  WebApp::Support::Show Error Dialog.gvi
  Perspective::Table::Table Update.gvi
diagram:
  call "Viewer Create.gvi"(container=reference to "HTML Container") -> (viewer reference=w1, error out=w2)
  call "Table Create.gvi"(schema="data.gtype" {all zero or empty}) -> (table reference=w3, error out=w4)
  Merge Errors(w2, w4) -> (error out=w5)
  call "Viewer Load.gvi"(viewer reference in=w1, table reference=w3, error in=w5) -> (error out=w6)
  call "Show Error Dialog.gvi"(error in=w6)
  s1 = w4  # shift register
  while (iteration -> i1) {
    Divide(x=i1, y=f64 default) -> w7
    Sine(x=w7) -> w8
    Multiply(w8, 10) -> w9
    Property Node(instance in="data.gtype" {all zero or empty}, "x"=i1, "y"=w9) -> (instance out=w10)
    Build Array(w10) -> w11
    call "Table Update.gvi"(table reference in=w3, data=w11, error in=s1) -> (error out=w12)
    Wait(time to wait=$"interval (ms)")
    next s1 = w12
    stop if w12
  }
  call "Show Error Dialog.gvi"(error in=s1)
