vi "Parse File.gvi"   [LabVIEW NXG 5.0.0]
inputs:
  "error in": error
  "uppy file references": "NI.JavaScriptReference"[]
outputs:
  "value": cluster{"value": f64[]}[]
  "error out": error
uses:
  File::Read File.gvi
diagram:
  Array Index(array=$"uppy file references") -> (out0[_]=w1)
  call "Read File.gvi"(file reference in=w1, error in=$"error in") -> (file reference out=w2, file contents=w3, error out=w4)
  Close Reference(error in=w4, reference=w2) -> (error out=w5)
  $"error out" <- w5
  Byte Array To String(unsigned byte array=w3) -> (string=w6)
  Unflatten From Json(JSON string=w6, type and defaults=cluster{"value": f64[]}[] []) -> (value=w7)
  $value <- w7
