vi "Destroy Plotly.gvi"   [LabVIEW NXG 5.1.0]
inputs:
  "error in": error
  "plotly reference": "plotly reference.gtype", required
outputs:
  "error out": error
types:
  "plotly reference.gtype" = "NI.JavaScriptReference"
uses:
  Plotly::Support::Plotly.jsli::Destroy
diagram:
  call "Destroy"(plotly=$"plotly reference") -> (error out=w1)
  Close Reference(error in=w1, reference=$"plotly reference") -> (error out=w2)
  Merge Errors($"error in", w2) -> (error out=w3)
  $"error out" <- w3
