vi "index.gviweb"   [G Web Development Software 22.3.0]
panel controls:
  "reset": bool
uses:
  Plotly::Create Plotly.gvi
  Plotly::Destroy Plotly.gvi
diagram:
  call "Create Plotly.gvi"(container=reference to "plotly") -> (plot div reference=w1, error out=w2)
  s1 = w1  # shift register
  s2 = w2  # shift register
  while {
    event (timeout = 10) {
      on "Timeout" {
        w3 = s1
        w4 = s2
      }
      on "reset" Value changed {
        call "Destroy Plotly.gvi"(plotly div reference=s1, error in=s2) -> (error out=w5)
        call "Create Plotly.gvi"(container=reference to "plotly", error in=w5) -> (plot div reference=w3, error out=w4)
      }
    }
    next s1 = w3
    next s2 = w4
    stop if w4
  }
