vi "Create Pie.gvi"   [LabVIEW NXG 5.0.0]
inputs:
  "placeholder text": string = "rgraph-webvi-pie", required
  "data": cluster{"Label": string, "Value": f64}[]
  "error in": error
  "plot colors": string[] = ["#7A1619", "#0A8EE2", "#E1B583", " #B6AB25", "#ADDBEE", "#9F8AAF", "#7E7E7E", "#3B0725"]
  "show labels": bool
  "show sticks": bool
outputs:
  "error out": error
  "RGraph refnum": i32
uses:
  RGraph::Pie::SubVIs::Format Pie Data.gvi
  RGraph::Pie::SubVIs::Format Pie Options.gvi
  RGraph::Advanced::Create RGraph.gvi
diagram:
  call "Format Pie Data.gvi"(data=$data) -> (value properties json=w1)
  call "Format Pie Options.gvi"(data=$data, plot colors=$"plot colors", show labels=$"show labels", show sticks=$"show sticks") -> (options json=w2)
  call "Create RGraph.gvi"(placeholder text=$"placeholder text", value properties json=w1, options json=w2, error in=$"error in", RGraph constructor name="RGraph.Pie") -> (RGraph refnum=w3, error out=w4)
  $"RGraph refnum" <- w3
  $"error out" <- w4
