vi "Create Quill.gvi"   [LabVIEW NXG 3.1.0]
# Creates a Quill based rich text area.
# Use the supported formats input to enable the formats that will be possible in the quill editor.
# Use the hidden toolbar formats input to hide any of the enabled formats from the toolbar.
inputs:
  "selector": string, required
  "error in": error
  "supported formats": string[] = ["font", "size", "spacer", "bold", "italic", "underline", "strike", "spacer", "color", "background", "spacer", "script", "spacer", "code", "link", "spacer", "header", "blockquote", "code-block", "spacer", "list", "indent", "spacer", "direction", "align", "spacer", "formula", "image", "video", "clean"]
  "disabled": bool
  "quill plugins": "quill plugins.gtype"
outputs:
  "quill reference": "quill reference.gtype"
  "error out": error
types:
  "quill reference.gtype" = i32
  "quill plugins.gtype" = string[]
uses:
  NI::G Core::Error::Build Error Cluster.gvi
  Quill::Support::Quill.jsli::CreateQuill
diagram:
  for {
    w1 = each element of $"quill plugins"
    Search 1D Array(1D array=$"supported formats", element=w1) -> (index of element=w2)
    Is Less Than 0(x=w2) -> w3
    stop if w3
  }
  case (w3) {
    frame False, Default {
      w4 = $"error in"
    }
    frame True {
      Concatenate Strings("Make sure plugins are included in quill toolbar. Missing: ", w1) -> w5
      call "Build Error Cluster.gvi"(error in=$"error in", code=567100, description=w5) -> (error out=w4)
    }
  }
  Flatten To JSON(anything=$"supported formats") -> (JSON string=w6)
  call "CreateQuill"(selector=$selector, formatsJSON=w6, disabled=$disabled, error in=w4) -> (quillReference=w7, error out=w8)
  $"quill reference" <- w7
  $"error out" <- w8
