vi "Append Formula Plugin.gvi"   [G Web Development Software 22.3.0]
inputs:
  "quill plugins in": "quill plugins.gtype"
  "error in": error
outputs:
  "quill plugins out": "quill plugins.gtype"
  "error out": error
types:
  "quill plugins.gtype" = string[]
uses:
  Quill::Support::Katex.jsli::ValidateKatex
diagram:
  Build Array($"quill plugins in", ["formula"]) -> w1
  $"quill plugins out" <- w1
  call "ValidateKatex"(error in=$"error in") -> (error out=w2)
  $"error out" <- w2
