vi "quill.gviweb"   [LabVIEW NXG 3.1.0]
panel controls:
  "submit": bool
panel indicators:
  "quill input": string
  "quill output": string
  "deltas json": string
uses:
  Quill::Plugins::Append Code-Block Plugin.gvi
  Quill::Plugins::Append Formula Plugin.gvi
  Quill::Create Quill.gvi
  Quill::Get Content.gvi
  Quill::Set Content.gvi
diagram:
  call "Append Code-Block Plugin.gvi"() -> (quill plugins out=w1, error out=w2)
  call "Append Formula Plugin.gvi"(quill plugins in=w1, error in=w2) -> (quill plugins out=w3, error out=w4)
  call "Create Quill.gvi"(selector=".my-quill-input", quill plugins=w3, error in=w4) -> (quill reference=w5)
  call "Append Code-Block Plugin.gvi"() -> (quill plugins out=w6, error out=w7)
  call "Append Formula Plugin.gvi"(quill plugins in=w6, error in=w7) -> (quill plugins out=w8, error out=w9)
  call "Create Quill.gvi"(disabled=TRUE, selector=".my-quill-output", quill plugins=w8, error in=w9) -> (quill reference=w10)
  while {
    event {
      on "submit" Value changed {
        call "Get Content.gvi"(quill reference in=w5) -> (deltas json=w11)
        $"deltas json" <- w11
        call "Set Content.gvi"(quill reference in=w10, deltas json=w11)
      }
    }
    stop if FALSE
  }
