vi "trix.gviweb"   [LabVIEW NXG 3.1.0]
panel controls:
  "submit": bool
panel indicators:
  "trix input": string
  "trix output": string
  "content": string
uses:
  Trix::Create Trix.gvi
  Trix::Get Content.gvi
  Trix::Set Content.gvi
diagram:
  call "Create Trix.gvi"(disabled=TRUE, selector=".my-trix-output") -> (trix reference=w1)
  call "Create Trix.gvi"(selector=".my-trix-input") -> (trix reference=w2)
  while {
    event {
      on "submit" Value changed {
        call "Get Content.gvi"(trix reference in=w2) -> (content=w3)
        $content <- w3
        call "Set Content.gvi"(trix reference in=w1, content=w3)
      }
    }
    stop if FALSE
  }
