vi "snake.gviweb"   [LabVIEW NXG 3.0.0]
panel controls:
  "Left": bool
  "Right": bool
panel indicators:
  "direction": f64
  "🐍🍴🍎": i32
  "Graph": "xyplot.gtype"[]
types:
  "xyplot.gtype" = cluster{"X": i32[], "Y": i32[]}
uses:
  Application::next_move.gvi
  Application::collision_self.gvi
  Application::collision_wall.gvi
  Application::resolve_apples.gvi
  Application::xyplot_delete.gvi
diagram:
  Decrement(x=8) -> w1
  # input loop
  while {
    event {
      on "Right" Value changed {
        Decrement(x=$direction) -> w2
        Is Less(x=w2, y=0) -> w3
        Select(s=w3, t=w1, f=w2) -> w4
        $direction <- w4
      }
      on "Left" Value changed {
        Increment(x=$direction) -> w5
        Is Greater(x=w5, y=w1) -> w6
        Select(s=w6, t=0, f=w5) -> w7
        $direction <- w7
      }
    }
    stop if FALSE
  }
  # game loop
  while {
    # world size
    # initial snake size
    # initial apples
    Divide(x=1000, y=2) -> w8
    Initialize Array(element=w8, size=25) -> w9
    Initialize Array(element=w8, size=25) -> w10
    # initial snake
    Property Node(instance in="xyplot.gtype" {all zero or empty}, "X"=w9, "Y"=w10) -> (instance out=w11)
    Sign(number=10) -> (-1, 0, 1=w12)
    # snake/apple unit
    # apples
    # eaten
    # movement loop
    s1 = w11  # shift register
    s2 = "xyplot.gtype" {all zero or empty}  # shift register
    s3 = w12  # shift register
    s4 = 0  # shift register
    while (iteration -> i1) {
      # execute the move
      Wait(time to wait=50)
      call "next_move.gvi"(Direction max=8, Direction=$direction, Snake Unit=15, Snake In=s1) -> (X=w13, Y=w14, Snake Out=w15)
      call "collision_self.gvi"(Snake Plot=w15) -> (Result=w16)
      call "collision_wall.gvi"(X=w13, Y=w14, World Size=1000) -> (Result=w17)
      Logical Or(w16, w17) -> w18
      call "resolve_apples.gvi"(Apples In=s2, World Size=1000, Apple Unit=15, Max Apples=20, X=w13, Y=w14) -> (Apples Out=w19, Ate Apple=w20)
      w21 = "xyplot.gtype" {"X"=[0, 1000, 1000, 0, 0], "Y"=[0, 0, 1000, 1000, 0]}
      Property Node(instance in=s1) -> ("X"=w22)
      Array Size(array=w22) -> (size(s)=w23)
      Select(s=w20, t=i1, f=s3) -> w24
      Subtract(x=i1, y=w24) -> w25
      Is Less(x=w25, y=10) -> w26
      # delete when we have not ate an apple in the last 5 moves
      case (w26) {
        frame False, Default {
          call "xyplot_delete.gvi"(XY Plot Input=w15, index=w23) -> (XY Plot Output=w27)
        }
        frame True {
          w27 = w15
        }
      }
      # display the snake and apples
      Build Array(w27, w19, w21) -> w28
      $Graph <- w28
      Increment(x=s4) -> w29
      Select(s=w20, t=w29, f=s4) -> w30
      $"🐍🍴🍎" <- w30
      next s1 = w27
      next s2 = w19
      next s3 = w24
      next s4 = w30
      stop if w18
    }
    Random Number() -> (number (0 to 1)=w31)
    Multiply(w31, 8) -> w32
    Round Toward Negative Infinity(x=w32) -> w33
    # last index ate apple at
    # (degrees)
    $direction <- w33
    stop if FALSE
  }
