vi "Prompt.gvi"   [LabVIEW NXG 3.1.0]
inputs:
  "error in": error
  "message": string, required
outputs:
  "value": string
  "error out": error
uses:
  SweetAlert::Advanced::Configure::Base Options.gvi
  SweetAlert::Advanced::Configure::Confirm Button Options.gvi
  SweetAlert::Advanced::Operate::Open Sweet Alert.gvi
diagram:
  call "Base Options.gvi"(message=$message)
  call "Confirm Button Options.gvi"()
  call "Open Sweet Alert.gvi"(error in=$"error in") -> (dismiss reason=w1, value=w2, error out=w3)
  $value <- w2
  $"error out" <- w3
