vi "index.gviweb"   [LabVIEW NXG 4.0.0]
panel controls:
  "show dialog": bool
  "title": string = "This is an example title"
  "message": string = "This is a message describing the dialog"
  "icon": T2 = "success"
  "footer": string = "<a href=\"#\">Some additional information that may be helpful!</a>"
  "input text type": T3 = "none"
  "placeholder text": string = "Hey friend! enter a value!"
  "initial value": string = "A boring default value"
  "enable confirm button?": bool = TRUE
  "confirm button text": string = "OK"
  "confirm button background color": enum{"default", "red", "blue", "green"} = "default"
  "enable cancel button?": bool = TRUE
  "cancel button background color": enum{"default", "red", "blue", "green"} = "default"
  "cancel button text": string = "Cancel"
  "enable progress steps?": bool = TRUE
  "steps": cluster{"steps": string}[] = [{"steps"="😁"}, {"steps"="😀"}, {"steps"="😅"}, {"steps"="😆"}, {"steps"="😍"}]
  "current steps index": i32 = 1
  "animation?": bool = TRUE
  "backdrop?": bool = TRUE
  "Prompt": bool
  "prompt message": string = "This is a simple prompt!"
  "prompt default": string = "one nice default"
  "toast?": bool
  "timer (seconds)": f64 = 8
  "show timer progress bar?": bool = TRUE
  "position": T4 = "center"
  "grow": enum{"default", "row", "column", "fullscreen"} = "default"
  "Show Styled Dialog": bool
panel indicators:
  "dismiss reason": T1
  "value": string
  "prompt value": string
  "prompt cancelled?": bool
  "styled dialog dismiss reason": T1
types:
  T1 = enum{"unknown", "success", "backdrop", "cancel", "close", "esc", "timer"}
  T2 = enum{"none", "success", "info", "question", "warning", "error"}
  T3 = enum{"none", "text", "email", "password", "number", "tel", "textarea", "url"}
  T4 = enum{"top-start", "top", "top-end", "center-start", "center", "center-end", "bottom-start", "bottom", "bottom-end"}
uses:
  SweetAlert::Advanced::Configure::Base Options.gvi
  SweetAlert::Advanced::Configure::Input Text Options.gvi
  SweetAlert::Advanced::Configure::Confirm Button Options.gvi
  SweetAlert::Advanced::Configure::Cancel Button Options.gvi
  SweetAlert::Advanced::Configure::Progress Steps Options.gvi
  SweetAlert::Advanced::Configure::Modal Window Options.gvi
  SweetAlert::Advanced::Operate::Open Sweet Alert.gvi
  SweetAlert::Prompt.gvi
  MySweetAlertStyles::Set My Sweet Alert Styles.gvi
diagram:
  while {
    event {
      on "show dialog" Value changed {
        call "Base Options.gvi"(footer=$footer, title=$title, message=$message, icon=$icon, animation?=$"animation?", backdrop?=$"backdrop?") -> (options out=w1)
        call "Input Text Options.gvi"(options in=w1, input text type=$"input text type", placeholder text=$"placeholder text", initial value=$"initial value") -> (options out=w2)
        case ($"confirm button background color") {
          frame "red" {
            w4 = 4294748303  # Color
            w3 = w4
          }
          frame "blue" {
            w5 = 4287870947  # Color
            w3 = w5
          }
          frame "green" {
            w6 = 4291488412  # Color
            w3 = w6
          }
          frame "default" {
            w3 = 4281370070
          }
        }
        call "Confirm Button Options.gvi"(options in=w2, enable?=$"enable confirm button?", text=$"confirm button text", background color=w3) -> (options out=w7)
        case ($"cancel button background color") {
          frame "red" {
            w9 = 4294748303  # Color
            w8 = w9
          }
          frame "blue" {
            w10 = 4287870947  # Color
            w8 = w10
          }
          frame "green" {
            w11 = 4291488412  # Color
            w8 = w11
          }
          frame "default" {
            w8 = 4289374890
          }
        }
        call "Cancel Button Options.gvi"(options in=w7, enable?=$"enable cancel button?", text=$"cancel button text", background color=w8) -> (options out=w12)
        for {
          w13 = each element of $steps
          Property Node(instance in=w13) -> ("steps"=w15)
          append w15 to w14
        }
        case ($"enable progress steps?") {
          frame False, Default {
            w16 = w12
          }
          frame True {
            call "Progress Steps Options.gvi"(options in=w12, progress steps=w14, progress index=$"current steps index") -> (options out=w16)
          }
        }
        call "Modal Window Options.gvi"(options in=w16, toast?=$"toast?", timer=$"timer (seconds)", show timer progress bar?=$"show timer progress bar?", position=$position, grow=$grow) -> (options out=w17)
        call "Open Sweet Alert.gvi"(options=w17) -> (dismiss reason=w18, value=w19)
        $"dismiss reason" <- w18
        $value <- w19
      }
      on "Prompt" Value changed {
        call "Prompt.gvi"(message=$"prompt message", default=$"prompt default") -> (value=w20, cancelled?=w21)
        $"prompt value" <- w20
        $"prompt cancelled?" <- w21
      }
      on "Show Styled Dialog" Value changed {
        call "Base Options.gvi"(footer="Awesome styled footer", title="Awesome styled title", message="Awesome styled message") -> (options out=w22)
        call "Cancel Button Options.gvi"(options in=w22) -> (options out=w23)
        call "Set My Sweet Alert Styles.gvi"(options in=w23) -> (options out=w24)
        call "Open Sweet Alert.gvi"(options=w24) -> (dismiss reason=w25)
        $"styled dialog dismiss reason" <- w25
      }
    }
    stop if FALSE
  }
