vi "URL Get Parts.gvi"   [LabVIEW NXG 5.1.0]
# Splits the URL into the different parts.
# NOTE: The parts of the URL are still percent encoded. Use the Query String VIs to manipulate the hash and search parts when applicable. For low-level parsing use URL Component Decode to first decode the URL parts.
inputs:
  "url": string, required
  "error in": error
outputs:
  "url parts": "url parts.gtype"
  "error out": error
types:
  "url parts.gtype" = cluster{"origin": string, "protocol": string, "username": string, "password": string, "host": string, "hostname": string, "port": string, "pathname": string, "search": string, "hash": string, "href": string}
uses:
  URL::Support::URL.jsli::URLGetParts
diagram:
  call "URLGetParts"(url=$url, error in=$"error in") -> (urlPartsJSON=w1, error out=w2)
  Unflatten From Json(JSON string=w1, error in (no error)=w2, type and defaults="url parts.gtype" {all zero or empty}) -> (error out=w3, value=w4)
  $"url parts" <- w4
  $"error out" <- w3
