vi "Window Location Get Search Parameter.gvi"   [LabVIEW NXG 5.1.0]
inputs:
  "error in": error
  "key": string, required
outputs:
  "error out": error
  "value": string
  "exists": bool
uses:
  URL::Window Location::Window Location Get.gvi
  URL::URL::URL Parameters::URL Get Search Parameter.gvi
diagram:
  call "Window Location Get.gvi"(error in=$"error in") -> (url=w1, error out=w2)
  call "URL Get Search Parameter.gvi"(url=w1, key=$key, error in=w2) -> (value=w3, exists=w4, error out=w5)
  $value <- w3
  $exists <- w4
  $"error out" <- w5
