vi "Window Location Set Search Parameter.gvi"   [G Web Development Software 22.3.0]
inputs:
  "error in": error
  "key": string, required
  "window location set action": "window location set action.gtype" = "set"
  "value": string, required
  "top level?": bool
outputs:
  "error out": error
types:
  "window location set action.gtype" = enum{"set", "push", "replace"}
uses:
  URL::Window Location::Window Location Get.gvi
  URL::URL::URL Parameters::URL Set Search Parameter.gvi
  URL::Window Location::Window Location Set.gvi
diagram:
  call "Window Location Get.gvi"(top level?=$"top level?", error in=$"error in") -> (url=w1, error out=w2)
  call "URL Set Search Parameter.gvi"(url=w1, key=$key, value=$value, error in=w2) -> (updated url=w3, error out=w4)
  call "Window Location Set.gvi"(url=w3, error in=w4, window location set action=$"window location set action") -> (error out=w5)
  $"error out" <- w5
