vi "index.gviweb"   [LabVIEW NXG 5.1.0]
panel controls:
  "navigate": bool
panel indicators:
  "window location": string
  "search": string
  "url": string
  "query string parts": cluster{"key": string, "value": string}[]
uses:
  URL::Location::Get Window Location.gvi
  URL::URL::URL Get Parts.gvi
  URL::Query String::Advanced::Query String Get Parts.gvi
  URL::URL::Calculate Relative URL.gvi
  URL::Location::Set Window Location.gvi
diagram:
  call "Get Window Location.gvi"() -> (url=w1)
  $"window location" <- w1
  call "URL Get Parts.gvi"(url=w1) -> (url parts=w2)
  Property Node(instance in=w2) -> ("search"=w3)
  $search <- w3
  call "Query String Get Parts.gvi"(query string=w3) -> (query string parts=w4)
  $"query string parts" <- w4
  call "Calculate Relative URL.gvi"(relative url="../", base url (window location)=w1) -> (url=w5)
  $url <- w5
  while {
    event {
      on "navigate" Value changed {
        call "Set Window Location.gvi"(url="https://www.ni.com")
      }
    }
    stop if FALSE
  }
