vi "Destroy Uppy Files.gvi"   [LabVIEW NXG 3.1.0]
inputs:
  "uppy file references": "uppy file reference.gtype"[], required
  "error in": error
outputs:
  "error out": error
types:
  "uppy file reference.gtype" = i32
uses:
  Uppy::Support::Uppy.jsli::DestroyUppyFiles
diagram:
  call "DestroyUppyFiles"(uppy file references=$"uppy file references") -> (error out=w1)
  Merge Errors($"error in", w1) -> (error out=w2)
  $"error out" <- w2
