vi "Destroy Uppy.gvi"   [LabVIEW NXG 3.1.0]
inputs:
  "uppy reference": "uppy reference.gtype", required
  "error in": error
outputs:
  "error out": error
types:
  "uppy reference.gtype" = i32
uses:
  Uppy::Support::Uppy.jsli::DestroyUppy
diagram:
  call "DestroyUppy"(uppy reference=$"uppy reference") -> (error out=w1)
  Merge Errors($"error in", w1) -> (error out=w2)
  $"error out" <- w2
