vi "index.gviweb"   [LabVIEW NXG 3.1.0]
panel controls:
  "Button": bool
panel indicators:
  "error out": error
  "Array Constant": u8[]
uses:
  Uppy::Uppy::Create Uppy.gvi
  Uppy::Uppy::Set Uppy Core Options.gvi
  Uppy::Uppy::Set Uppy Dashboard Options.gvi
  Uppy::Uppy::Set Uppy Webcam Options.gvi
  Uppy::Uppy::Request Uppy Files.gvi
  Uppy::Uppy File::Read Uppy File.gvi
  Uppy::Uppy File::Destroy Uppy Files.gvi
  Uppy::Uppy::Destroy Uppy.gvi
diagram:
  while {
    event {
      on "Button" Value changed {
        call "Create Uppy.gvi"() -> (uppy refnum=w2, error out=w3)
        call "Set Uppy Core Options.gvi"(uppy refnum in=w2, error in=w3, max number of files=1, allowed file types=["image/*"]) -> (uppy refnum out=w4, error out=w5)
        call "Set Uppy Dashboard Options.gvi"(uppy refnum in=w4, error in=w5, show uppy icon?=FALSE) -> (uppy refnum out=w6, error out=w7)
        call "Set Uppy Webcam Options.gvi"(uppy refnum in=w6, error in=w7) -> (uppy refnum out=w8, error out=w9)
        call "Request Uppy Files.gvi"(uppy refnum in=w8, error in=w9) -> (uppy refnum out=w10, uppy file refnums=w11, error out=w12)
        s1 = w12  # shift register
        for {
          w13 = each element of w11
          call "Read Uppy File.gvi"(uppy file refnum in=w13, error in=s1) -> (uppy file refnum out=w15, file contents=w16, error out=w17)
          $"Array Constant" <- w16
          append w15 to w14
          next s1 = w17
          stop if w17
        }
        call "Destroy Uppy Files.gvi"(uppy file refnums=w14, error in=s1) -> (error out=w18)
        call "Destroy Uppy.gvi"(uppy refnum=w10, error in=w18) -> (error out=w1)
      }
    }
    stop if w1
  }
  $"error out" <- w1
