vi "Create Video Element.gvi"   [G Web Development Software 22.0.0]
inputs:
  "placeholder html container reference": "HtmlContainer reference", required
  "error in": error
  "source url": string, required
outputs:
  "error out": error
uses:
  VideoElement::Support::VideoElement.jsli::Create
diagram:
  Obtain JavaScript Reference(reference in=$"placeholder html container reference", error in=$"error in") -> (error out=w1, javascript reference out=w2)
  call "Create"(placeholder=w2, source=$"source url", error in=w1) -> (error out=w3)
  Close Reference(error in=w3, reference=w2) -> (error out=w4)
  $"error out" <- w4
