vi "index.gviweb"   [LabVIEW NXG 5.0.0]
panel controls:
  "Button": bool
  "win1": bool
  "win2": bool
  "lose1": bool
  "lose2": bool
  "achievment1": bool
  "achievment2": bool
panel indicators:
  "time": waveform<f32>
  "frequency": waveform<f32>
uses:
  WebAudio::AudioNodes::Create Media Stream Audio Source Node.gvi
  WebAudio::Analyser::Create Analyzer.gvi
  WebAudio::AudioContextState::Get Sample Rate.gvi
  WebAudio::Analyser::Get Analyser Frequency Data.gvi
  WebAudio::Analyser::Get Analyser Time Domain Data.gvi
  WebAudio::Buffers::Create Audio Buffer From URL.gvi
  WebAudio::AudioNodes::Get Audio Destination Node.gvi
  WebAudio::Buffers::Play Audio Buffer.gvi
diagram:
  sequence {
    frame 0 {
      while {
        Wait(time to wait=500)
        stop if $Button
      }
    }
    frame 1 {
      call "Create Media Stream Audio Source Node.gvi"() -> (audio node reference=w1, error out=w2)
      call "Create Analyzer.gvi"(audio node reference=w1, error in=w2) -> (analyser reference=w3, error out=w4)
    }
  }
  call "Get Sample Rate.gvi"(error in=w4) -> (sample rate=w5, error out=w6)
  s1 = w6  # shift register
  while {
    call "Get Analyser Frequency Data.gvi"(analyser reference=w3, error in=s1) -> (frequency data=w7, error out=w8)
    call "Get Analyser Time Domain Data.gvi"(analyser reference=w3, error in=w8) -> (time domain data=w9, error out=w10)
    Reciprocal(x=w5) -> w11
    Multiply(w11, 1000) -> w12
    Build Waveform Node(Y=w9, dt=w12) -> (output waveform=w13)
    $time <- w13
    To Double Precision Float(number=w5) -> w14
    Divide(x=w14, y=2) -> w15
    Array Size(array=w7) -> (size(s)=w16)
    To Double Precision Float(number=w16) -> w17
    Divide(x=w15, y=w17) -> w18
    Build Waveform Node(Y=w7, dt=w18) -> (output waveform=w19)
    $frequency <- w19
    Wait(time to wait=10)
    next s1 = w10
    stop if w10
  }
  Property Node(instance in=s1) -> ("source"=w20)
  One Button Dialog(message=w20)
  call "Create Audio Buffer From URL.gvi"(url="Support/270333__littlerobotsoundfactory__jingle-win-00.wav") -> (audio buffer reference=w21)
  call "Create Audio Buffer From URL.gvi"(url="Support/270319__littlerobotsoundfactory__jingle-win-01.wav") -> (audio buffer reference=w22)
  w23 = "Support/270329__littlerobotsoundfactory__jingle-lose-00.wav"
  call "Create Audio Buffer From URL.gvi"(url=w23) -> (audio buffer reference=w24)
  w25 = "Support/270334__littlerobotsoundfactory__jingle-lose-01.wav"
  call "Create Audio Buffer From URL.gvi"(url=w25) -> (audio buffer reference=w26)
  w27 = "Support/270331__littlerobotsoundfactory__jingle-achievement-00.wav"
  call "Create Audio Buffer From URL.gvi"(url=w27) -> (audio buffer reference=w28)
  w29 = "Support/270330__littlerobotsoundfactory__jingle-achievement-01.wav"
  call "Create Audio Buffer From URL.gvi"(url=w29) -> (audio buffer reference=w30)
  Build Array(w21, w22, w24, w26, w28, w30) -> w31
  call "Get Audio Destination Node.gvi"() -> (destination audio node reference=w32, error out=w33)
  while {
    event {
      on "achievment1" Value changed; "achievment2" Value changed; "lose1" Value changed; "lose2" Value changed; "win1" Value changed; "win2" Value changed {
        Event Data() -> ("Index"=w34)
        Array Index(array=w31) -> (out0[w34]=w35)
        call "Play Audio Buffer.gvi"(audio buffer reference=w35, destination audio node reference=w32, error in=w33)
      }
    }
    stop if FALSE
  }
