vi "BatteryLevel.gviweb"   [LabVIEW NXG 5.0.0]
panel controls:
  "connect to battery": bool
panel indicators:
  "value": u8[]
  "id": string
  "name": string
uses:
  WebBluetooth::Service::Service UUID (String).gvi
  WebBluetooth::Device::Append Filter.gvi
  WebBluetooth::Device::Request Device.gvi
  WebBluetooth::Device::Get Device Information.gvi
  WebBluetooth::Service::GATT Server Connect.gvi
  WebBluetooth::Service::Get Primary Service.gvi
  WebBluetooth::Characteristic::Characteristic UUID (String).gvi
  WebBluetooth::Characteristic::Get Characteristic.gvi
  WebBluetooth::Characteristic::Read Value.gvi
  WebBluetooth::Service::GATT Server Disconnect.gvi
diagram:
  while {
    event {
      on "connect to battery" Value changed {
        call "Service UUID (String).gvi"(name="battery_service") -> (uuid=w2)
        Build Array(w2) -> w3
        call "Append Filter.gvi"(services=w3) -> (filters out=w4)
        call "Request Device.gvi"(filters=w4) -> (device reference=w5, error out=w6)
        call "Get Device Information.gvi"(device reference in=w5, error in=w6) -> (device reference out=w7, id=w8, name=w9, error out=w10)
        call "GATT Server Connect.gvi"(device reference in=w7, error in=w10) -> (device reference out=w11, error out=w12)
        call "Service UUID (String).gvi"(name="battery_service") -> (uuid=w13)
        call "Get Primary Service.gvi"(device reference in=w11, service uuid=w13, error in=w12) -> (service reference=w14, error out=w15)
        call "Characteristic UUID (String).gvi"(name="battery_level") -> (uuid=w16)
        call "Get Characteristic.gvi"(service reference in=w14, characteristic uuid=w16, error in=w15) -> (characteristic reference=w17, error out=w18)
        sequence {
          frame 0 {
            call "Read Value.gvi"(characteristic reference in=w17, error in=w18) -> (value=w19, error out=w20)
            $value <- w19
          }
        }
        call "GATT Server Disconnect.gvi"(device reference=w7, error in=w20) -> (error out=w1)
        $id <- w8
        $name <- w9
      }
    }
    stop if w1
  }
  Property Node(instance in=w1) -> ("source"=w21)
  One Button Dialog(message=w21)
