vi "Dotti.gviweb"   [LabVIEW NXG 5.0.0]
panel controls:
  "Connect": bool
  "one": u32
uses:
  WebApp::Support::Set Row Color.gvi
  WebBluetooth::Characteristic::Write Value.gvi
  WebBluetooth::Service::Service UUID (String).gvi
  WebBluetooth::Device::Append Filter.gvi
  WebBluetooth::Device::Request Device.gvi
  WebBluetooth::Service::GATT Server Connect.gvi
  WebBluetooth::Service::Get Primary Service.gvi
  WebBluetooth::Characteristic::Characteristic UUID (String).gvi
  WebBluetooth::Characteristic::Get Characteristic.gvi
diagram:
  s1 = uninitialised  # shift register
  while {
    event {
      on "one" Value changed {
        Event Data() -> ("New Value"=w3)
        for (N = 8) (iteration -> i1) {
          Is Less(x=w3, y=i1) -> w4
          w5 = 4293794853  # Color
          Select(s=w4, t=4278190080, f=w5) -> w6
          Decrement(x=8) -> w7
          Subtract(x=w7, y=i1) -> w8
          call "Set Row Color.gvi"(row number=w8, color=w6) -> (message=w9)
          call "Write Value.gvi"(characteristic reference in=s1, value=w9) -> (error out=w1)
          stop if w1
        }
        w2 = s1
      }
      on "Connect" Value changed {
        call "Service UUID (String).gvi"(name="0000fff0-0000-1000-8000-00805f9b34fb") -> (uuid=w10)
        Property Node(instance in=reference to "Connect", "Text"=["connecting"], "Disabled"=TRUE) -> (error out=w11)
        call "Append Filter.gvi"(name prefix="Dotti") -> (filters out=w12)
        Build Array(w10) -> w13
        call "Request Device.gvi"(optional service uuids=w13, filters=w12, error in=w11) -> (device reference=w14, error out=w15)
        call "GATT Server Connect.gvi"(device reference in=w14, error in=w15) -> (device reference out=w16, error out=w17)
        call "Get Primary Service.gvi"(device reference in=w16, service uuid=w10, error in=w17) -> (service reference=w18, error out=w19)
        call "Characteristic UUID (String).gvi"(name="0000fff3-0000-1000-8000-00805f9b34fb") -> (uuid=w20)
        call "Get Characteristic.gvi"(service reference in=w18, characteristic uuid=w20, error in=w19) -> (characteristic reference=w2, error out=w21)
        Property Node(instance in=reference to "Connect", "Text"=["connected"], error in=w21) -> (error out=w1)
      }
    }
    next s1 = w2
    stop if w1
  }
  Property Node(instance in=w1) -> ("source"=w22)
  One Button Dialog(message=w22)
