vi "PuckJSBlink.gviweb"   [LabVIEW NXG 5.0.0]
panel controls:
  "Connect to Puck.js": bool
  "Toggle LED": bool
uses:
  WebBluetooth::Characteristic::Write Value.gvi
  WebBluetooth::Service::Service UUID (String).gvi
  WebBluetooth::Device::Append Filter.gvi
  WebBluetooth::Device::Request Device.gvi
  WebBluetooth::Service::GATT Server Connect.gvi
  WebBluetooth::Service::Get Primary Service.gvi
  WebBluetooth::Characteristic::Characteristic UUID (String).gvi
  WebBluetooth::Characteristic::Get Characteristic.gvi
diagram:
  s1 = uninitialised  # shift register
  while {
    event {
      on "Toggle LED" Value changed {
        Event Data() -> ("New Value"=w3)
        Select(s=w3, t="LED1.write(1)\n", f="LED1.write(0)\n") -> w4
        String To Byte Array(string=w4) -> (unsigned byte array=w5)
        call "Write Value.gvi"(characteristic reference in=s1, value=w5) -> (error out=w1)
        w2 = s1
      }
      on "Connect to Puck.js" Value changed {
        Property Node(instance in=reference to "Connect to Puck.js", "Text"=["connecting"], "Disabled"=TRUE) -> (error out=w6)
        call "Service UUID (String).gvi"(name="6e400001-b5a3-f393-e0a9-e50e24dcca9e", error in=w6) -> (uuid=w7)
        Build Array(w7) -> w8
        call "Append Filter.gvi"(services=w8) -> (filters out=w9)
        call "Request Device.gvi"(filters=w9) -> (device reference=w10, error out=w11)
        call "GATT Server Connect.gvi"(device reference in=w10, error in=w11) -> (device reference out=w12, error out=w13)
        call "Get Primary Service.gvi"(device reference in=w12, service uuid=w7, error in=w13) -> (service reference=w14, error out=w15)
        call "Characteristic UUID (String).gvi"(name="6e400002-b5a3-f393-e0a9-e50e24dcca9e") -> (uuid=w16)
        call "Get Characteristic.gvi"(service reference in=w14, characteristic uuid=w16, error in=w15) -> (characteristic reference=w2, error out=w17)
        Property Node(instance in=reference to "Connect to Puck.js", "Text"=["connected"], error in=w17) -> (error out=w1)
      }
    }
    next s1 = w2
    stop if w1
  }
  Property Node(instance in=w1) -> ("source"=w18)
  One Button Dialog(message=w18)
