vi "main.gviweb"   [LabVIEW NXG 3.1.0]
uses:
  Electron::Initialize Electron.gvi
  Electron::Create Browser Window.gvi
diagram:
  call "Initialize Electron.gvi"() -> (error out=w1)
  call "Create Browser Window.gvi"(error in=w1)
