vi "main.gviweb"   [LabVIEW NXG 3.1.0]
uses:
  Console::Console Log.gvi
  Express::Run Express Application.gvi
  NI::WebSockets::Open WebSocket.gvi
  NI::WebSockets::Write String.gvi
  NI::WebSockets::Read String.gvi
  NI::WebSockets::Close WebSocket.gvi
diagram:
  call "Console Log.gvi"(message="Starting Express application...") -> (error out=w1)
  call "Run Express Application.gvi"(client path="../Client_HelloWorld", error in=w1) -> (error out=w2)
  call "Console Log.gvi"(message="Finished starting Express application.", error in=w2) -> (error out=w3)
  call "Open WebSocket.gvi"(url="wss://echo.websocket.org/?encoding=text", error in=w3) -> (websocket session out=w4, error out=w5)
  call "Write String.gvi"(websocket session in=w4, string message="Echooo", error in=w5) -> (websocket session out=w6, error out=w7)
  call "Read String.gvi"(websocket session in=w6, timeout=3, error in=w7) -> (websocket session out=w8, string response=w9, error out=w10)
  call "Close WebSocket.gvi"(websocket session in=w8, error in=w10) -> (error out=w11)
  call "Console Log.gvi"(message=w9, error in=w11) -> (error out=w12)
  call "Console Log.gvi"(message="Websocket done", error in=w12)
