vi "Inspect Panel Values.gvi"   [LabVIEW NXG 5.0.0]
uses:
  WebVIDebugger::Support::WebVIDebugger.jsli::InspectPanelValues
diagram:
  Call Chain() -> (callchain=w1)
  Flatten To Json(anything=w1) -> (JSON string=w2)
  call "InspectPanelValues"(callChainJSON=w2)
