vi "webvi-devtools-panel.gviweb"   [LabVIEW NXG 5.0.0]
panel controls:
  "allow updates": bool = TRUE
panel indicators:
  "updates loop count": i32
  "messages": cluster{"location": string, "data": string}[]
  "selector": error
uses:
  WebVIDevTools::Support::WebVIDevTools.jsli::WaitForEvent
  TreeFormatter::Format JSON for Tree.gvi
diagram:
  while (iteration -> i1) {
    case ($"allow updates") {
      frame False, Default { }
      frame True {
        call "WaitForEvent"() -> (inspectPanelResultJSON=w1, error out=w2)
        call "Format JSON for Tree.gvi"(json=w1, error in=w2) -> (tree=w3, error out=w4)
        case (w4) {
          frame Error, Default {
            $selector <- w4
          }
          frame No Error {
            $messages <- w3
          }
        }
      }
    }
    Wait(time to wait=10)
    $"updates loop count" <- i1
    stop if FALSE
  }
