vi "index.gviweb"   [G Web Development Software 22.3.0]
panel indicators:
  "String": string
uses:
  NI::G Core::Operating System::Write to System Log.gvi
  NI::WebSockets::Open WebSocket.gvi
  NI::WebSockets::Write String.gvi
  NI::WebSockets::Read String.gvi
  NI::WebSockets::Close WebSocket.gvi
  WebVIDeno::Support::WebVIDeno.jsli::Log
  URL::URL::Advanced::URL Parts::URL Get Parts.gvi
  DenoHTTP::Support::DenoHTTP.jsli::StartServer
  DenoHTTP::Support::DenoHTTP.jsli::ListenForRequest
  DenoHTTP::Support::DenoHTTP.jsli::StreamResultWebVIRequest
  DenoHTTP::Support::DenoHTTP.jsli::CompleteRequest
diagram:
  Concatenate Strings("Opening websocket echo server connection to: ", "wss://ws.ifelse.io/") -> w1
  call "Write to System Log.gvi"(message="hello world!") -> (error out=w2)
  call "Write to System Log.gvi"(message=w1, error in=w2) -> (error out=w3)
  call "Open WebSocket.gvi"(url="wss://ws.ifelse.io/", error in=w3) -> (websocket session out=w4, error out=w5)
  call "Write String.gvi"(websocket session in=w4, string message="[Echo]", error in=w5) -> (websocket session out=w6, error out=w7)
  s1 = w7  # shift register
  s2 = w6  # shift register
  while {
    call "Read String.gvi"(websocket session in=s2, timeout=3, error in=s1) -> (websocket session out=w8, string response=w9, error out=w10)
    call "Write to System Log.gvi"(message=w9, error in=w10) -> (error out=w11)
    Search Or Split String(search string/char="[Echo]", string=w9) -> (offset of match=w12)
    Is Greater Or Equal To 0(x=w12) -> w13
    Logical Or(w11, w13) -> w14
    next s1 = w11
    next s2 = w8
    stop if w14
  }
  call "Close WebSocket.gvi"(websocket session in=s2, error in=s1) -> (error out=w15)
  call "Write to System Log.gvi"(message="Finished WebSocket connection.", error in=w15)
  $String <- "hello world!"
  call "Log"()
  call "URL Get Parts.gvi"(url="http://www.google.com") -> (url parts=w16)
  Property Node(instance in=w16) -> ("href"=w17)
  call "Write to System Log.gvi"(message=w17)
  call "StartServer"() -> (requestStreamReader=w18, error out=w19)
  s3 = w19  # shift register
  while (iteration -> i1) {
    Format Into String(formatString="request %d", i1) -> w20
    call "ListenForRequest"(requestStreamReader=w18, error in=s3) -> (streamResult=w21, error out=w22)
    call "StreamResultWebVIRequest"(streamResult=w21, error in=w22) -> (webviRequest=w23, error out=w24)
    call "CompleteRequest"(webviRequest=w23, body=w20, error in=w24) -> (error out=w25)
    call "Write to System Log.gvi"(message=w20)
    next s3 = w25
    stop if w25
  }
