vi "main.gviweb"   [G Web Development Software 21.0.0]
uses:
  NI::G Core::Operating System::Write to System Log.gvi
  WebVINodePath::Get Component Directory.gvi
  NI::WebSockets::Open WebSocket.gvi
  NI::WebSockets::Write String.gvi
  NI::WebSockets::Read String.gvi
  NI::WebSockets::Close WebSocket.gvi
diagram:
  call "Write to System Log.gvi"(message="Starting WebSocket connection...") -> (error out=w1)
  call "Get Component Directory.gvi"(error in=w1) -> (working directory=w2, error out=w3)
  call "Write to System Log.gvi"(message=w2, error in=w3) -> (error out=w4)
  To Variant(anything="Whats up") -> w5
  Variant To Data(error in (no error)=w4, type=string "", variant=w5) -> (data=w6, error out=w7)
  call "Write to System Log.gvi"(message=w6, error in=w7) -> (error out=w8)
  Concatenate Strings("Opening websocket echo server connection to: ", "wss://echo.websocket.org/?encoding=text") -> w9
  call "Write to System Log.gvi"(message=w9, error in=w8) -> (error out=w10)
  call "Open WebSocket.gvi"(url="wss://echo.websocket.org/?encoding=text", error in=w10) -> (websocket session out=w11, error out=w12)
  call "Write String.gvi"(websocket session in=w11, string message="Echooo", error in=w12) -> (websocket session out=w13, error out=w14)
  call "Read String.gvi"(websocket session in=w13, timeout=3, error in=w14) -> (websocket session out=w15, string response=w16, error out=w17)
  call "Close WebSocket.gvi"(websocket session in=w15, error in=w17) -> (error out=w18)
  call "Write to System Log.gvi"(message=w16, error in=w18) -> (error out=w19)
  call "Write to System Log.gvi"(message="Finished WebSocket connection.", error in=w19)
